# Grasshopper definition My first grasshopper script.gh (Grasshopper 1.0.7)
# Copyright: 2022-14-37

pt = Point(Point(-129.3438724, -131.4759402, 0))
pt_2 = Point(Point(113.3003028, 98.46258079, 118.8271605))
box = Box2Pt(PointA=pt, PointB=pt_2, Plane=PlaneXY(0, 0, 0))
addition = Addition(A="4", B=Slider(2, range=0..5))
debrep = DeconstructBrep(Brep=box)  # -> Faces, Edges, Vertices
panel = Panel(addition)
item = ListItem(List=debrep.Faces, Index=Slider(4, range=0..5), Wrap=True)
item_2 = ListItem(List=debrep.Faces, Index=Slider(5, range=0..5), Wrap=True)
preview = CustomPreview(Geometry=item_2, Material=ColourSwatch(SwatchColor=RGB(140, 140, 140)))
preview_2 = CustomPreview(Geometry=item, Material=ColourSwatch(SwatchColor=RGB(145, 29, 29)))
