# Grasshopper definition Parametric courtyard.gh (Grasshopper 1.0.7)
# Copyright: 2021

length = Slider(60, range=20..60)
width = Slider(26, range=20..40)
building_height = Slider(9, range=9..21)
floor_to_ceiling_height = Panel("4000")
thickness = Slider(12, range=10..20)
window_to_wall = Slider(0.4, range=0..1)
pln = Plane(PlaneXY(0, 0, 0))
crv = Curve(<curve referenced from the Rhino model>)
crv_2 = Curve(<curve referenced from the Rhino model>)
Z = UnitZ(Factor=floor_to_ceiling_height)
multiplication = Multiplication(A=width, B="1000")
multiplication_2 = Multiplication(A=length, B="1000")
extr = Extrude(Base=crv, Direction=Z)
multiplication_3 = Multiplication(A=thickness, B="1000")
extr_2 = Extrude(Base=crv_2, Direction=Z)
cap = CapHoles(Brep=extr)
rectangle = Rectangle(Plane=pln, XSize=multiplication, YSize=multiplication_2, Radius=0)  # -> Rectangle, Length
expression = Expression(
    x=width,
    y=length,
    z=building_height,
    u=window_to_wall,
    Expression="Format(\"Cw{0}_Cl{1}_Bh{2}_WWR{3}\", x, y, z, u * 100)")
panel = Panel(expression)
cap_2 = CapHoles(Brep=extr_2)
floor = Panel("5")
internal_walls = Panel("""0
1
3""")
ceiling = Panel("4")
external_wall = Panel("2")
offset = OffsetCurve(Curve=rectangle.Rectangle, Distance=multiplication_3, Corners=1)
debrep = DeconstructBrep(Brep=cap_2)  # -> Faces, Edges, Vertices
area = Area(Geometry=debrep.Faces)  # -> Area, Centroid
boundary = BoundarySurfaces(Edges=flatten([offset, rectangle.Rectangle]))
item = ListItem(List=debrep.Faces, Index=external_wall, Wrap=True)
multiplication_4 = Multiplication(A=building_height, B="1000")
item_2 = ListItem(List=debrep.Faces, Index=ceiling, Wrap=True)
item_3 = ListItem(List=debrep.Faces, Index=internal_walls, Wrap=True)
item_4 = ListItem(List=debrep.Faces, Index=floor, Wrap=True)
points = PointList(Points=area.Centroid)
Z_2 = UnitZ(Factor=multiplication_4)
extr_3 = Extrude(Base=boundary, Direction=Z_2)
area_2 = Area(Geometry=item)  # -> Area, Centroid
preview = CustomPreview(Geometry=item_2, Material=ColourSwatch(SwatchColor=RGB(240, 199, 89)))
preview_2 = CustomPreview(Geometry=item_4, Material=ColourSwatch(SwatchColor=RGB(150, 108, 48)))
sqrt = SquareRoot(Value=window_to_wall)
preview_3 = CustomPreview(Geometry=item_3, Material=ColourSwatch(SwatchColor=RGB(59, 176, 0)))
cap_3 = CapHoles(Brep=extr_3)
scale = Scale(Geometry=item, Center=area_2.Centroid, Factor=sqrt)  # -> Geometry, Transform
edges = BrepEdges(Brep=item)  # -> Naked, Interior, NonManifold
join = JoinCurves(Curves=edges.Naked, Preserve=False)
edges_2 = BrepEdges(Brep=scale.Geometry)  # -> Naked, Interior, NonManifold
sdiff = SolidDifference(BrepsA=cap_3, BrepsB=cap)
join_2 = JoinCurves(Curves=edges_2.Naked, Preserve=False)
preview_4 = CustomPreview(Geometry=sdiff, Material=ColourSwatch(SwatchColor=RGB(143, 143, 143)))
boundary_2 = BoundarySurfaces(Edges=[join, join_2])
X = UnitX(Factor="500")
extr_4 = Extrude(Base=boundary_2, Direction=X)
preview_5 = CustomPreview(Geometry=extr_4, Material=ColourSwatch(SwatchColor=RGB(108, 143, 107)))
