# Grasshopper definition Cleanup parametric courtyard.gh (Grasshopper 1.0.7)
# Copyright: 2021
# Copyright: 2022-14-37

courtyard_length = Slider(37, range=20..60)
building_height = Slider(11, range=9..21)
courtyard_width = Slider(25, range=20..40)
units = Panel("1000")
plane_outside_the_apartment = Plane(PlaneXY(0, 33763.41447, 0))
window_to_wall = Slider(0.5, range=0..1)

# ---- group: apartment
# Create apartment
# and parts
ground_outline_of_aparment = Curve(<curve referenced from the Rhino model>)
floor_to_ceiling_height = Panel("4000")
Z = UnitZ(Factor=floor_to_ceiling_height)
extr = Extrude(Base=ground_outline_of_aparment, Direction=Z)
cap = CapHoles(Brep=extr)
debrep = DeconstructBrep(Brep=cap)  # -> Faces, Edges, Vertices

# ----
expression = Expression(
    x=courtyard_width,
    y=courtyard_length,
    z=building_height,
    u=window_to_wall,
    Expression="Format(\"Cw{0}_Cl{1}_Bh{2}_WWR{3}\", x, y, z, u * 100)")

# ---- group: Building
# Create the courtyard building
input_plane = Plane(plane_outside_the_apartment)
units_2 = Number(units)
courtyard_length_2 = Number(courtyard_length)
courtyard_width_2 = Number(courtyard_width)
building_height_2 = Number(building_height)
multiplication = Multiplication(A=courtyard_length_2, B=units_2)
division = Division(A=multiplication, B=2)
neg = Negative(Value=division)
thickness = Slider(12, range=10..20)
multiplication_2 = Multiplication(A=courtyard_width_2, B=units_2)
dom = ConstructDomain(DomainStart=neg, DomainEnd=division)
rectangle = Rectangle(Plane=input_plane, XSize=multiplication_2, YSize=dom, Radius=0)  # -> Rectangle, Length
multiplication_3 = Multiplication(A=thickness, B=units_2)
offset = OffsetCurve(Curve=rectangle.Rectangle, Distance=multiplication_3, Corners=1)
multiplication_4 = Multiplication(A=building_height_2, B=units_2)
boundary = BoundarySurfaces(Edges=flatten([offset, rectangle.Rectangle]))
Z_2 = UnitZ(Factor=multiplication_4)
extr_2 = Extrude(Base=boundary, Direction=Z_2)
cap_2 = CapHoles(Brep=extr_2)
solid_building = Brep(cap_2)

# ---- group: apartment
external_wall = Panel("2")
item = ListItem(List=debrep.Faces, Index=external_wall, Wrap=True)
external_wall_2 = Brep(item)

internal_walls = Panel("""0
1
3""")
item_2 = ListItem(List=debrep.Faces, Index=internal_walls, Wrap=True)
int_walls = Brep(item_2)

floor = Panel("5")
item_3 = ListItem(List=debrep.Faces, Index=floor, Wrap=True)
floor_2 = Brep(item_3)

ceiling = Panel("4")
item_4 = ListItem(List=debrep.Faces, Index=ceiling, Wrap=True)
ceiling_2 = Brep(item_4)

ground_outline_for_cutout = Curve(<curve referenced from the Rhino model>)
extr_3 = Extrude(Base=ground_outline_for_cutout, Direction=Z)
cap_3 = CapHoles(Brep=extr_3)
solid_apartment = Brep(cap_3)

# ----
panel = Panel(expression)
wwr = Number(window_to_wall)
extrude_facade = ExtrudeFacade(external_wall=external_wall_2, wwr=wwr, wall_thickness="500")

# ----
# Remove apartment from building
solid_apartment_2 = Brep(solid_apartment)
solid_building_2 = Brep(solid_building)
sdiff = SolidDifference(BrepsA=solid_building_2, BrepsB=solid_apartment_2)
cutout_building = Brep(sdiff)

preview = CustomPreview(Geometry=extrude_facade, Material=ColourSwatch(SwatchColor=RGB(108, 143, 107)))
preview_2 = CustomPreview(Geometry=int_walls, Material=ColourSwatch(SwatchColor=RGB(59, 176, 0)))
preview_3 = CustomPreview(Geometry=floor_2, Material=ColourSwatch(SwatchColor=RGB(150, 108, 48)))
preview_4 = CustomPreview(Geometry=ceiling_2, Material=ColourSwatch(SwatchColor=RGB(240, 199, 89)))
preview_5 = CustomPreview(Geometry=cutout_building, Material=ColourSwatch(SwatchColor=RGB(143, 143, 143)))

# ==== cluster ExtrudeFacade
wwr = ClusterInput()
external_wall = ClusterInput()
wwr_2 = Number(wwr)
external_wall_2 = Brep(external_wall)
sqrt = SquareRoot(Value=wwr_2)
area = Area(Geometry=external_wall_2)  # -> Area, Centroid
scale = Scale(Geometry=external_wall_2, Center=area.Centroid, Factor=sqrt)  # -> Geometry, Transform
edges = BrepEdges(Brep=external_wall_2)  # -> Naked, Interior, NonManifold
join = JoinCurves(Curves=edges.Naked, Preserve=False)
edges_2 = BrepEdges(Brep=scale.Geometry)  # -> Naked, Interior, NonManifold
join_2 = JoinCurves(Curves=edges_2.Naked, Preserve=False)
wall_thickness = ClusterInput()
wall_thickness_2 = Number(wall_thickness)
boundary = BoundarySurfaces(Edges=[join, join_2])
X = UnitX(Factor=wall_thickness_2)
extr = Extrude(Base=boundary, Direction=X)
extruded_external_wall = Brep(extr)
extruded_external_wall_2 = ClusterOutput(extruded_external_wall)
