# Grasshopper definition HB Model daylight.gh (Grasshopper 1.0.7)
# Copyright: 2021
# plug-ins: Human, HDTTreeUtils, LadybugGrasshopper

# ----
# Get sublayer items
panel = Panel("Daylight_Inputs::*")
panel_2 = Panel("""Mesh
Polysurface
Surface
Extrusion""")
dpipeline = DynamicGeometryPipeline(
    LayerFilter=panel,
    TypeFilter=panel_2,
    NameFilter="*",
    GroupByLayer=False,
    GroupByType=False,
    IncludeHidden=True,
    IncludeLocked=True,
    enableFullPath=True,
    listenToAttributes=True)

project_name = Panel("Sample_Project_001")
run = BooleanToggle(True)

# ----
# Grid setup
vertical_offset = Panel("0.75m")
grid_size = Panel("0.5m")
quadonly = BooleanToggle(False)
docunits = ConvertToDocumentUnits(ValueString=vertical_offset)
docunits_2 = ConvertToDocumentUnits(ValueString=grid_size)

# ----
# Sort by layer
objatts = ObjectAttributes(ObjectOrAttributes=dpipeline)  # -> Name, LayerName, LayerFullPath, Color, MaterialName, LinetypeName, GroupIndices, PlotWeight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
cset = CreateSet(List=objatts.LayerName)  # -> Set, Map
assign_paths = AssignPaths(InputData=flatten(dpipeline), PathsToAssign=flatten(cset.Map))

python = GhPythonScript(layer_name=graft(cset.Set))  # -> is_opaque, is_transparent, is_grid
# ---------- python: Python ----------
__author__ = "mm1013"
__version__ = "2022.01.16"

import rhinoscriptsyntax as rs

is_grid = layer_name == "Grids"

if is_grid:
    is_opaque = False
    is_transparent = False
else:
    is_transparent = layer_name.endswith("%")
    if is_transparent:
        transmittance = layer_name.split("_")[-1].replace("%","")
    is_opaque = not is_transparent
# ---------- end python ----------

# ----
# Opaque objects
cull = CullPattern(List=graft(cset.Set), CullPattern=graft(python.is_opaque))  # -> simplify(List)
cull_2 = CullPattern(List=assign_paths, CullPattern=graft(python.is_opaque))  # -> simplify(List)
panel_3 = Panel(cull)
python_2 = GhPythonScript(layer_name=panel_3)  # -> out, reflectance
# ---------- python_2: Python ----------
__author__ = "mm1013"
__version__ = "2022.01.16"

import rhinoscriptsyntax as rs
try:
    reflectance = layer_name.split("_")[-1]
    
except:
    reflectance = None
# ---------- end python_2 ----------
clean = CleanTree(
    RemoveNulls=True,
    RemoveInvalid=True,
    RemoveEmpty=True,
    Tree=cull,
    SynchronousTree1=cull_2,
    SynchronousTree2=python_2.reflectance)  # -> Tree, SynchronousTree1, SynchronousTree2
refl = Number(expr("x/100", clean.SynchronousTree2))
geo = Geometry(clean.SynchronousTree1)
name = Text(clean.Tree)
opaquemod = HBOpaqueModifier(name=name, reflect=refl)  # -> modifier; plug-in component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
faceradianceattr = HBFaceRadianceAttributes({"Modifier": "properties.radiance.modifier.display_name", "Average Reflectance": "properties.radiance.modifier.average_reflectance", "Average Transmittance": "properties.radiance.modifier.average_transmittance", "Modifier Blk": "properties.radiance.modifier_blk.display_name", "Is Opaque": "properties.radiance.is_opaque", "Dynamic Group": "properties.radiance.dynamic_group_identifier", "State Count": "properties.radiance.state_count", "States": "properties.radiance.states"}, selected="Modifier")  # disabled
shade = HBShade(geo=geo, name=name, rad_mod=opaquemod)  # -> report, shades; plug-in component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
colorfaceattr = HBColorFaceAttributes(hb_objs=flatten(shade.shades), attribute=faceradianceattr)  # -> mesh, legend, wire_frame, values, colors; disabled; plug-in component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

# ----
# Transparent objects
cull_3 = CullPattern(List=graft(cset.Set), CullPattern=graft(python.is_transparent))  # -> simplify(List)
cull_4 = CullPattern(List=assign_paths, CullPattern=python.is_transparent)
panel_4 = Panel(cull_3)
python_3 = GhPythonScript(layer_name=cull_3)  # -> out, transmittance, name
# ---------- python_3: Python ----------
__author__ = "mm1013"
__version__ = "2022.01.16"

import rhinoscriptsyntax as rs

try:
    transmittance = layer_name.split("_")[-1].replace("%","")
    name = layer_name.replace("%","")
except:
    transmittance = None
    name = None
# ---------- end python_3 ----------
clean_2 = CleanTree(
    RemoveNulls=True,
    RemoveInvalid=True,
    RemoveEmpty=True,
    Tree=simplify(cull_4),
    SynchronousTree1=simplify(python_3.name),
    SynchronousTree2=simplify(python_3.transmittance))  # -> Tree, SynchronousTree1, SynchronousTree2
transmittance = Number(expr("x/100", clean_2.SynchronousTree2))
name_2 = Text(clean_2.SynchronousTree1)
geo_2 = Geometry(clean_2.Tree)
glassmod = HBGlassModifier(name=name_2, trans=transmittance)  # -> modifier; plug-in component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
faceradianceattr_2 = HBFaceRadianceAttributes({"Modifier": "properties.radiance.modifier.display_name", "Average Reflectance": "properties.radiance.modifier.average_reflectance", "Average Transmittance": "properties.radiance.modifier.average_transmittance", "Modifier Blk": "properties.radiance.modifier_blk.display_name", "Is Opaque": "properties.radiance.is_opaque", "Dynamic Group": "properties.radiance.dynamic_group_identifier", "State Count": "properties.radiance.state_count", "States": "properties.radiance.states"}, selected="Average Transmittance")
shade_2 = HBShade(geo=geo_2, name=name_2, rad_mod=glassmod)  # -> report, shades; plug-in component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
colorfaceattr_2 = HBColorFaceAttributes(hb_objs=flatten(shade_2.shades), attribute=faceradianceattr_2)  # -> mesh, legend, wire_frame, values, colors; disabled; plug-in component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

grid_size_2 = Number(docunits_2)
offset = Number(docunits)

# ----
# Grids
cull_5 = CullPattern(List=graft(cset.Set), CullPattern=graft(python.is_grid))  # -> simplify(List)
cull_6 = CullPattern(List=assign_paths, CullPattern=python.is_grid)
quad_only = Boolean(quadonly)
panel_5 = Panel(cull_5)
clean_3 = CleanTree(RemoveNulls=True, RemoveInvalid=True, RemoveEmpty=True, Tree=cull_5, SynchronousTree1=simplify(cull_6))  # -> Tree, SynchronousTree1
geo_3 = Geometry(graft(clean_3.SynchronousTree1))
name_3 = Text(clean_3.Tree)
rectangle = Rectangle(Plane=PlaneXY(0, 0, 0), XSize=Domain(-1, 1), YSize=Domain(-2, 2), Radius=0)  # -> Rectangle, Length
flip = Flip(Surface=geo_3, Guide=rectangle.Rectangle)  # -> Surface, Result
objatts_2 = ObjectAttributes(ObjectOrAttributes=geo_3)  # -> Name, LayerName, LayerFullPath, Color, MaterialName, LinetypeName, GroupIndices, PlotWeight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
panel_6 = Panel(objatts_2.Name)
genpts = LBGeneratePointGrid(geometry=flip.Surface, grid_size=grid_size_2, offset_dist=offset, quad_only=quad_only)  # -> points, vectors, face_areas, graft(mesh); plug-in component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
sensorgrid = HBSensorGrid(name=objatts_2.Name, positions=genpts.points, directions=genpts.vectors)  # -> grid; plug-in component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
panel_7 = Panel(sensorgrid)

falsestart = LBFalseStartToggle(True)
path = FilePath("C:\Users\mm1013\Videos\NLITED\1.5 Pollination\PollinationModel.hbjson")
loadobjects = HBLoadObjects(hb_file=path, load=falsestart)  # -> report, hb_objs; plug-in component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
getgridsviews = HBGetGridsAndViews(model=loadobjects.hb_objs)  # -> views, grids, points, meshes; plug-in component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
model = HBModel(shades=flatten([shade.shades, shade_2.shades]), name=project_name)  # -> report, model; plug-in component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
merge_models = GhPythonScript(model_1=model.model, model_2=loadobjects.hb_objs)  # -> out, model
# ---------- merge_models: Python ----------
__author__ = "mm1013"
__version__ = "2022.01.16"

import rhinoscriptsyntax as rs

model_1.add_model(model_2)

model = model_1
# ---------- end merge_models ----------
assigngridsviews = HBAssignGridsAndViews(model=merge_models.model, grids=flatten([sensorgrid, getgridsviews.grids]))  # -> model; plug-in component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
entwine = Entwine(Branch00=genpts.mesh, Branch01=getgridsviews.meshes, FlattenInputs=True)
mjoin = MeshJoin(Meshes=flatten(entwine))
vizwiref = HBVisualizeWireframe(hb_objs=flatten(assigngridsviews))  # -> geo; plug-in component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
preview = CustomPreview(Geometry=vizwiref, Material=ColourSwatch(SwatchColor=RGB(140, 140, 140)))

colrange = LBColorRange(index=Slider(3, range=0..25))  # -> colors; plug-in component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
legendpar = LBLegendParameters(min="0", max="20", seg_count="11", colors=colrange, num_decimals="0")  # -> leg_par; plug-in component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

# ----
# Run Recipe
daylightfactor = HBDaylightFactor(model=assigngridsviews, run=run)  # -> report, results; plug-in component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

# ----
# Visualize
# Results
mesh = Mesh(mjoin)
values = Data(flatten(daylightfactor.results))
heatmap = LBSpatialHeatmap(values=flatten(values), mesh=graft(mesh), legend_par=legendpar, legend_title="Daylight Factor (%)")  # -> mesh, legend, title, colors, legend_par; plug-in component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

facen = FaceNormals(Mesh=mesh)  # -> Centers, Normals
expression = Expression(x=values, Expression="Format(\"{0:0.0}\", x)")
docunits_3 = ConvertToDocumentUnits(ValueString="100mm")
tag = TextTag3D(Location=facen.Centers, Text=expression, Size=docunits_3, Colour=ColourSwatch(SwatchColor=RGB(0, 0, 0)), Justification=5)
panel_8 = Panel(expression)
