# Grasshopper definition gridbased_daylightfactor.gh (Grasshopper 1.0.7)

# ---- group: Opaque Faces
geo = Geometry([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])
roomsolid = HBRoomFromSolid(geo=flatten(geo), name="TestRoom", conditioned=True)  # -> report, rooms; plug-in component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

# ---- group: Apertures
# Geometry Preparation
panel = Panel("glass_material")
transmod = HBTranslucentModifier(name="diffusing_material", diff_ref="0.1", diff_trans="0.5")  # -> modifier; plug-in component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
glassmod = HBGlassModifier(name=panel, trans="0.6")  # -> modifier; plug-in component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
brep = Brep([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])
brep_2 = Brep([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])
aperture = HBAperture(geo=brep, rad_mod=glassmod)  # -> report, apertures; plug-in component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
aperture_2 = HBAperture(geo=brep_2, rad_mod=transmod)  # -> report, apertures; plug-in component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
addsubface = HBAddSubface(hb_obj=flatten(roomsolid.rooms), sub_faces=flatten([aperture.apertures, aperture_2.apertures]))  # -> hb_obj; plug-in component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
bordershades = HBExtrudedBorderShades(hb_objs=flatten(addsubface), depth="0.3")  # -> report, hb_objs; plug-in component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

# ---- group: Context!
brep_3 = Brep([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])
shade = HBShade(geo=brep_3)  # -> report, shades; plug-in component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

# ----
vizwiref = HBVisualizeWireframe(hb_objs=flatten(shade.shades))  # -> geo; plug-in component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
vizall = HBVisualizeAll(hb_objs=flatten(aperture_2.apertures))  # -> geo; plug-in component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
vizwiref_2 = HBVisualizeWireframe(hb_objs=flatten(bordershades.hb_objs))  # -> geo; plug-in component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

# ----
# Custom grid from detailed inputs
number_slider = Slider(0.762, range=0..1)
brep_4 = Brep([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])
genpts = LBGeneratePointGrid(geometry=brep_4, grid_size="0.5", offset_dist=number_slider)  # -> points, vectors, face_areas, graft(mesh); plug-in component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
panel_2 = Panel("""room_a
room_b""")
graft = GraftTree(Tree=brep_4, IncludeEmptyLists=True, IncludeNullItems=True)
graft_2 = GraftTree(Tree=panel_2, IncludeEmptyLists=True, IncludeNullItems=True)
sensorgrid = HBSensorGrid(name=graft_2, positions=genpts.points, directions=genpts.vectors, mesh=genpts.mesh, base_geo=graft)  # -> grid; plug-in component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

# ----
# Sky
panel_3 = Panel("https://energyplus-weather.s3.amazonaws.com/north_and_central_america_wmo_region_4/USA/MA/USA_MA_Boston-Logan.Intl.AP.725090_TMY3/USA_MA_Boston-Logan.Intl.AP.725090_TMY3.zip")
downloadepw = LBDownloadWeather(weather_URL=panel_3)  # -> epw_file, stat_file, ddy_file; plug-in component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
importloc = LBImportLocation(epw_file=downloadepw.epw_file)  # -> location; plug-in component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
ciesky = HBCIEStandardSky(
    north="180",
    location=importloc,
    month=Slider(3, range=1..12),
    day=Slider(21, range=1..31),
    hour=Slider(9, range=0..23),
    type=0)  # -> sky; plug-in component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

# ----
# Analysis Grids
# Auto-generated grid from room floors
panel_4 = Panel("0.5")
gridrooms = HBSensorGridFromRooms(rooms=bordershades.hb_objs, grid_size=panel_4)  # -> grid, points, mesh; plug-in component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

# ----
# Model
panel_5 = Panel("hb_sample_model_grid")
model = HBModel(rooms=flatten(bordershades.hb_objs), shades=flatten(shade.shades), name=panel_5)  # -> report, model; plug-in component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
assigngridsviews = HBAssignGridsAndViews(model=model.model, grids=flatten(gridrooms.grid))  # -> model; plug-in component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

vizwiref_3 = HBVisualizeWireframe(hb_objs=flatten(assigngridsviews))  # -> geo; plug-in component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
daylightfactor = HBDaylightFactor(model=assigngridsviews, run=Toggle(True))  # -> report, results; plug-in component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

legendpar = LBLegendParameters(min="0", max="10", num_decimals="0")  # -> leg_par; plug-in component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
mjoin = MeshJoin(Meshes=flatten(gridrooms.mesh))
heatmap = LBSpatialHeatmap(values=flatten(daylightfactor.results), mesh=mjoin, legend_par=legendpar, legend_title="daylight factor")  # -> mesh, legend, title, colors, legend_par; plug-in component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
