# Grasshopper definition HB Model daylight_illuminance_per_hour.gh (Grasshopper 1.0.7)
# Copyright: 2021
# Copyright: 2022-14-37
# plug-ins: Human, HDTTreeUtils, LadybugGrasshopper, PollinationGH, MantaRay

python = GhPythonScript(filename="DNK_DRY_OFFICIAL_2001-2010_epw-fil.epw")  # -> local_path
# ---------- python: Python ----------
__author__ = "mm1013"
__version__ = "2022.08.16"

import rhinoscriptsyntax as rs
if filename is not None:
    local_path = "\\".join(ghdoc.Path.split("\\")[:-1]) + "\\" + filename
else:
    local_path = "\\".join(ghdoc.Path.split("\\")[:-1]) + "\\"
# ---------- end python ----------

# ----
# DISCLAIMER:
# The Annual Daylight Autonomy is NOT using any dynamic blinds
# 
# This may be updated when newer versions of LBT supports it.
# 
# Take a look at https://github.com/Sonderwoods/NLITED for updates / bugfixes etc.
# Last updated
project_name = Panel("Sample_Project_001")

# ----
# Get sublayer items
panel = Panel("Daylight_Inputs::*")
panel_2 = Panel("""Mesh
Polysurface
Surface
Extrusion""")
dpipeline = DynamicGeometryPipeline(
    LayerFilter=panel,
    TypeFilter=panel_2,
    NameFilter="*",
    GroupByLayer=False,
    GroupByType=False,
    IncludeHidden=True,
    IncludeLocked=True,
    enableFullPath=True,
    listenToAttributes=True)

# ----
# Radiance parameters
simulation_type = ValueList({"Daylight Factor": 0, "Daylight Autonomy": 1, "Point in Time (VIEW)": 2}, selected="Daylight Autonomy")
ambient_bounces = ValueList({"Direct Sun Only": 0, "Sky only, ab 1": 1, "low, ab 3": 3, "medium, ab 5": 5, "high, ab 7": 7, "mega high, ab 9": 9}, selected="Sky only, ab 1")
detail_level = ValueList({"Low": 0, "Medium": 1, "High": 2}, selected="Medium")

# ----
# Load additional HBJSON files
# (from revit plugin etc)
file_path_to_hbjson = FilePath("C:\Users\mm1013\Videos\NLITED\2.2 first hb model\Sample_Project_001_From_Rhino.hbjson")
load = LBFalseStartToggle(False)

# ----
# Grid setup
grid_size = Panel("1m")
vertical_offset = Panel("0.75m")
quadonly = BooleanToggle(False)
docunits = ConvertToDocumentUnits(ValueString=vertical_offset)
docunits_2 = ConvertToDocumentUnits(ValueString=grid_size)

# ----
# Start the simulation
run = LBFalseStartToggle(True)

# ----
# Inputs for point in time
# Will update to active rhino view
# whenever you change the type
viewtype = ValueList({"* 0 Perspective (v)": 0, "* 1 Hemispherical fisheye (h)": 1, "* 2 Parallel (l)": 2, "* 3 Cylindrical panorama (c)": 3, "* 4 Angular fisheye (a)": 4, "* 5 Planisphere [stereographic] projection (s)": 5}, selected="* 4 Angular fisheye (a)")
metric = ValueList({"* 0  illuminance": 0, "* 1  irradiance": 1, "* 2  luminance": 2, "* 3  radiance": 3}, selected="* 2  luminance")
viewport = HBViewFromViewport(name="FromRhino", view_type=viewtype, refresh=run)  # -> view; plug-in component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

txt = Text(python)

# ----
# Weather data
panel_3 = Panel("https://energyplus-weather.s3.amazonaws.com/europe_wmo_region_6/FRA/FRA_Marseille.076500_IWEC/FRA_Marseille.076500_IWEC.zip")
falsestart = LBFalseStartToggle(False)
epwmap = LBEPWmap(epw_map=falsestart)  # -> report; plug-in component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
downloadepw = LBDownloadWeather(weather_URL=panel_3)  # -> epw_file, stat_file, ddy_file; plug-in component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
importloc = LBImportLocation(epw_file=txt)  # -> location; plug-in component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
wea = HBWeaFromEPW(epw_file=txt)  # -> wea; plug-in component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
panel_4 = Panel(importloc)

# ----
# Remember to
# update the dam!
dam = DataDam(DataA=dpipeline, BufferDelay=10000000, BufferMode=0)

# ----
# Sort by layer
objatts = ObjectAttributes(ObjectOrAttributes=dam)  # -> Name, LayerName, LayerFullPath, Color, MaterialName, LinetypeName, GroupIndices, PlotWeight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
cset = CreateSet(List=objatts.LayerName)  # -> Set, Map
assign_paths = AssignPaths(InputData=flatten(dam), PathsToAssign=flatten(cset.Map))
python_2 = GhPythonScript(layer_name=graft(cset.Set))  # -> is_opaque, is_transparent, is_grid, is_HB_Room, is_HB_Window
# ---------- python_2: Python ----------
__author__ = "mm1013"
__version__ = "2022.01.16"

import rhinoscriptsyntax as rs

is_grid = layer_name == "Grids"

if layer_name.startswith("HB_"):
    is_opaque = is_transparent = is_grid = False
    
    is_HB_Window = layer_name.endswith("%")
    is_HB_Room = layer_name == "HB_Rooms"
    
    
else:
    if is_grid:
        is_opaque = False
        is_transparent = False
    else:
        is_transparent = layer_name.endswith("%")
        if is_transparent:
            transmittance = layer_name.split("_")[-1].replace("%","")
        is_opaque = not is_transparent
# ---------- end python_2 ----------
layer_name = Text(cset.Set)
geo = Geometry(assign_paths)

# ----
# Opaque objects
cull = CullPattern(List=graft(layer_name), CullPattern=graft(python_2.is_opaque))  # -> simplify(List)
cull_2 = CullPattern(List=geo, CullPattern=graft(python_2.is_opaque))  # -> simplify(List)
panel_5 = Panel(cull)
python_3 = GhPythonScript(layer_name=panel_5)  # -> out, reflectance
# ---------- python_3: Python ----------
__author__ = "mm1013"
__version__ = "2022.01.16"

import rhinoscriptsyntax as rs
try:
    reflectance = layer_name.split("_")[-1]
    
except:
    reflectance = None
# ---------- end python_3 ----------
clean = CleanTree(
    RemoveNulls=True,
    RemoveInvalid=True,
    RemoveEmpty=True,
    Tree=cull,
    SynchronousTree1=cull_2,
    SynchronousTree2=python_3.reflectance)  # -> Tree, SynchronousTree1, SynchronousTree2
refl = Number(expr("x/100", clean.SynchronousTree2))
geo_2 = Geometry(clean.SynchronousTree1)
name = Text(clean.Tree)
opaquemod = HBOpaqueModifier(name=name, reflect=refl)  # -> modifier; plug-in component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
shade = HBShade(geo=geo_2, name=name, rad_mod=opaquemod)  # -> report, shades; plug-in component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

# ----
# Transparent objects
cull_3 = CullPattern(List=graft(layer_name), CullPattern=graft(python_2.is_transparent))  # -> simplify(List)
cull_4 = CullPattern(List=geo, CullPattern=python_2.is_transparent)
panel_6 = Panel(cull_3)
python_4 = GhPythonScript(layer_name=cull_3)  # -> out, transmittance, name
# ---------- python_4: Python ----------
__author__ = "mm1013"
__version__ = "2022.01.16"

import rhinoscriptsyntax as rs

try:
    transmittance = layer_name.split("_")[-1].replace("%","")
    name = layer_name.replace("%","")
except:
    transmittance = None
    name = None
# ---------- end python_4 ----------
clean_2 = CleanTree(
    RemoveNulls=True,
    RemoveInvalid=True,
    RemoveEmpty=True,
    Tree=simplify(cull_4),
    SynchronousTree1=simplify(python_4.name),
    SynchronousTree2=simplify(python_4.transmittance))  # -> Tree, SynchronousTree1, SynchronousTree2
transmittance = Number(expr("x/100", clean_2.SynchronousTree2))
name_2 = Text(clean_2.SynchronousTree1)
geo_3 = Geometry(clean_2.Tree)
glassmod = HBGlassModifier(name=name_2, trans=transmittance)  # -> modifier; plug-in component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
faceradianceattr = HBFaceRadianceAttributes({"Modifier": "properties.radiance.modifier.display_name", "Average Reflectance": "properties.radiance.modifier.average_reflectance", "Average Transmittance": "properties.radiance.modifier.average_transmittance", "Modifier Blk": "properties.radiance.modifier_blk.display_name", "Is Opaque": "properties.radiance.is_opaque", "Dynamic Group": "properties.radiance.dynamic_group_identifier", "State Count": "properties.radiance.state_count", "States": "properties.radiance.states"}, selected="Average Transmittance")
shade_2 = HBShade(geo=geo_3, name=name_2, rad_mod=glassmod)  # -> report, shades; plug-in component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
colorfaceattr = HBColorFaceAttributes(hb_objs=flatten(shade_2.shades), attribute=faceradianceattr)  # -> mesh, legend, wire_frame, values, colors; plug-in component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

grid_size_2 = Number(docunits_2)
offset = Number(docunits)
panel_7 = Panel(clean.SynchronousTree2)

# ----
# Wall opening material
panel_8 = Panel("Openings_70")
opaquemod_2 = HBOpaqueModifier(name=panel_8, reflect="0.7")  # -> modifier; plug-in component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

# ----
# Default wall width
panel_9 = Panel("500mm")

# ----
# Default modifers
# (double click to modify)
cluster = Cluster()

# ----
# Model_2 (external hbjson file)
loadobjects = HBLoadObjects(hb_file=file_path_to_hbjson, load=load)  # -> report, hb_objs; plug-in component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
getgridsviews = HBGetGridsAndViews(model=loadobjects.hb_objs)  # -> views, grids, points, meshes; plug-in component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
clean_3 = CleanTree(RemoveNulls=True, RemoveInvalid=True, RemoveEmpty=False, Tree=getgridsviews.meshes)
clean_4 = CleanTree(RemoveNulls=True, RemoveInvalid=True, RemoveEmpty=False, Tree=getgridsviews.grids)

# ----
# Parameters
simulation_type_2 = Integer(simulation_type)
expression = Expression(x=ambient_bounces, Expression="Format(\"-ab {0:0}\", x)")
panel_10 = Panel("""0
2
1""")
detail_level_2 = Integer(detail_level)
item = ListItem(List=panel_10, Index=simulation_type_2, Wrap=True)
radpar = HBRadianceParameter(recipe_type=item, detail_level=detail_level_2, additional_par=expression)  # -> rad_par; plug-in component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
panel_11 = Panel(radpar)

epw = FilePath(python)

# ----
# EN17037 - Daylight Hours
importepw = LBImportEPW(epw_file=epw)  # -> location, dry_bulb_temperature, dew_point_temperature, relative_humidity, wind_speed, wind_direction, direct_normal_rad, diffuse_horizontal_rad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; plug-in component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
xdata = LBDeconstructData(data=importepw.diffuse_horizontal_rad)  # -> header, values; plug-in component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
lng = ListLength(List=xdata.values)
series = Series(Start=0, Step=1, Count=lng)
sort = SortList(Keys=xdata.values, ValuesA=series)  # -> reverse(Keys), reverse(ValuesA)
subset = SubList(List=sort.ValuesA, Domain="0 to 4379", Wrap=True)  # -> List, Index
int = Integer("0")
dup = DuplicateData(Data=int, Number="8760", Order=True)
int_2 = Integer("1")
constrheader = LBConstructHeader(data_type="Illuminance", unit="lux")  # -> header; plug-in component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
replace = ReplaceItems(List=dup, Item=int_2, Indices=subset.List, Wrap=False)
schedule = Integer(replace)
data = LBConstructData(header=constrheader, values=schedule)  # -> data; plug-in component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
hourlyplot = LBHourlyPlot(data=data)  # -> report, mesh, legend, borders, labels, title; plug-in component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
schedule_2 = Integer(replace)
fixedintervalschedule = HBFixedIntervalSchedule(values=schedule_2, name="EN_DaylightHours")  # -> report, schedule; plug-in component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

# ----
# Fixed Schedule
panel_12 = Panel("1")  # disabled
panel_13 = Panel("31")  # disabled
panel_14 = Panel("12")  # disabled
panel_15 = Panel("8")  # disabled
panel_16 = Panel("18")  # disabled
analysisperiod = LBAnalysisPeriod(start_month=panel_12, start_day=panel_12, start_hour=panel_15, end_month=panel_14, end_day=panel_13, end_hour=panel_16)  # -> period, hoys, dates; disabled; plug-in component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
panel_17 = Panel("8760")  # disabled
panel_18 = Panel("0")  # disabled
int_3 = Integer(panel_18)  # disabled
panel_19 = Panel("lux")  # disabled
panel_20 = Panel("Illuminance")  # disabled
panel_21 = Panel("1")  # disabled
dup_2 = DuplicateData(Data=int_3, Number=panel_17, Order=True)  # disabled
int_4 = Integer(panel_21)  # disabled
constrheader_2 = LBConstructHeader(data_type=panel_20, unit=panel_19)  # -> header; disabled; plug-in component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
replace_2 = ReplaceItems(List=dup_2, Item=int_4, Indices=analysisperiod.hoys, Wrap=False)  # disabled
schedule_3 = Integer(replace_2)  # disabled
expression_2 = Expression(x=panel_15, y=panel_16, Expression="Format(\"Fixed Schedule from {0} to {1}\", x, y)")  # disabled
data_2 = LBConstructData(header=constrheader_2, values=schedule_3)  # -> data; disabled; plug-in component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
hourlyplot_2 = LBHourlyPlot(data=data_2)  # -> report, mesh, legend, borders, labels, title; disabled; plug-in component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
schedule_4 = Integer(replace_2)  # disabled
fixedintervalschedule_2 = HBFixedIntervalSchedule(values=schedule_4, name=expression_2)  # -> report, schedule; disabled; plug-in component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

line = Line()
north = GhPythonScript(line_input=line)  # -> north_vector; inputs line_input: Line
# ---------- north: Python ----------
__author__ = "mm1013"
__version__ = "2022.01.17"

import rhinoscriptsyntax as rs
import Rhino

if line_input is not None:
    
    north_vector = line_input.Direction
    north_vector.Unitize()
    start_point = line_input.From
else:
    north_vector = Rhino.Geometry.Vector3d(0,1,0)
    start_point = Rhino.Geometry.Point3d(0,0,0)

display_vector = north_vector * 10000
# ---------- end north ----------
end = EndPoints(Curve=line)  # -> Start, End
compass = LBCompass(north=north, center=end.Start)  # -> compass; plug-in component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

# ----
# download model and results from collaborators etc
check_job_status = CheckJobStatus(
    _job="sonderwoods/demo/4e6a9f82-960b-40c0-85f9-e1ec107674bb",
    Index_=0,
    getBothInputOutputAssets=False,
    liveUpdateStatus=True)
check_run_inputs = CheckRunInputs(
    _run=check_job_status,
    recipeSource="https://api.pollination.cloud/registries/ladybug-tools/recipe/daylight-factor/0.7.0")  # -> CpuCount, GridFilter, MinSensorCount, Model, RadianceParameters
check_run_results = CheckRunResults(
    _run=check_job_status,
    recipeSource="https://api.pollination.cloud/registries/ladybug-tools/recipe/daylight-factor/0.7.0")
load_assets = LoadAssets(
    Asset_1=check_run_inputs.Model,
    Asset_2=check_run_results,
    liveUpdateStatus=True,
    postprocessWithHandler=True,
    useCachedAssets=True)  # -> Logs, Value_1, Value_2, Value_3
toggle = BooleanToggle(True)  # disabled
loadobjects_2 = HBLoadObjects(hb_file=load_assets.Value_1, load=toggle)  # -> report, hb_objs; disabled; plug-in component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
vizquick = HBVisualizeQuick(hb_objs=flatten(loadobjects_2.hb_objs))  # -> geo; disabled; plug-in component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
panel_22 = Panel(loadobjects_2.hb_objs)  # disabled
getgridsviews_2 = HBGetGridsAndViews(model=loadobjects_2.hb_objs)  # -> views, grids, points, meshes; disabled; plug-in component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

simulation_type_3 = Integer(simulation_type)
equals = Equality(FirstNumber=simulation_type_3, SecondNumber="2")  # -> Equality, Inequality
and = GateAnd(A=equals.Equality, B=run)

simulation_type_4 = Integer(simulation_type)
equals_2 = Equality(FirstNumber=simulation_type_4, SecondNumber="0")  # -> Equality, Inequality
and_2 = GateAnd(A=equals_2.Equality, B=run)

simulation_type_5 = Integer(simulation_type)
equals_3 = Equality(FirstNumber=simulation_type_5, SecondNumber="1")  # -> Equality, Inequality
and_3 = GateAnd(A=equals_3.Equality, B=run)

docunits_3 = ConvertToDocumentUnits(ValueString="10m")
simulation_type_6 = Integer(simulation_type)
Z = UnitZ(Factor=docunits_3)

colrange = LBColorRange(index=Slider(7, range=0..25))  # -> colors; plug-in component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
legendpar = LBLegendParameters(min="0", max="100", seg_count="11", colors=colrange, num_decimals="0")  # -> leg_par; plug-in component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

pt = Point(Point(-3269.453823, -29377.65348, 2918.057305))
simulation_type_7 = Integer(simulation_type)

colrange_2 = LBColorRange(index=Slider(3, range=0..25))  # -> colors; plug-in component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
legendpar_2 = LBLegendParameters(
    min="0",
    max="15",
    seg_count="11",
    colors=colrange_2,
    num_decimals="0",
    base_plane=pt,
    seg_height="700",
    seg_width="1200",
    text_height="500")  # -> leg_par; plug-in component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

col = Colour([RGB(255, 248, 122), RGB(255, 248, 122), RGB(255, 248, 122), RGB(255, 248, 122), RGB(255, 248, 122), RGB(255, 248, 122), RGB(255, 248, 122), RGB(255, 248, 122), RGB(255, 248, 122), RGB(189, 189, 189)])
simulation_type_8 = Integer(simulation_type)
filter = StreamFilter(Gate=simulation_type_8, Stream0=legendpar_2, Stream1=legendpar)
simulation_type_9 = Integer(simulation_type)

simulation_type_10 = Integer(simulation_type)
threshold = Panel("""1.95
50""")
name_3 = Panel("""DF
DA""")
item_2 = ListItem(List=threshold, Index=simulation_type_10, Wrap=True)
item_3 = ListItem(List=name_3, Index=simulation_type_10, Wrap=True)

docunits_4 = ConvertToDocumentUnits(ValueString="100mm")
radviewer = RadViewer(IsTwoSided=False, Polychromatic=True, ShowEdges=True, Transparent=True)  # -> Meshes, Names, ModifierNames, Modifiers, FailedWireFrame

# ----
# HB_Rooms
# HB_Windows
cull_5 = CullPattern(List=geo, CullPattern=python_2.is_HB_Window)
cull_6 = CullPattern(List=graft(layer_name), CullPattern=graft(python_2.is_HB_Window))  # -> simplify(List)
cull_7 = CullPattern(List=geo, CullPattern=python_2.is_HB_Room)
rooms = Geometry(flatten(cull_7))
python_5 = GhPythonScript(layer_name=cull_6)  # -> out, transmittance, name; same code as python_4
roomsolid = HBRoomFromSolid(geo=flatten(rooms), conditioned=True)  # -> report, rooms; plug-in component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
clean_5 = CleanTree(
    RemoveNulls=True,
    RemoveInvalid=True,
    RemoveEmpty=True,
    Tree=python_5.transmittance,
    SynchronousTree1=python_5.name,
    SynchronousTree2=simplify(cull_5))  # -> Tree, SynchronousTree1, SynchronousTree2
solveadj = HBSolveAdjacency(rooms=flatten(roomsolid.rooms), run=Toggle(True))  # -> report, adj_rooms; plug-in component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
division = Division(A=clean_5.Tree, B=100)
toggle_2 = BooleanToggle(True)
glassmod_2 = HBGlassModifier(name=clean_5.SynchronousTree1, trans=division)  # -> modifier; plug-in component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
adiabaticbytype = HBAdiabaticByType(
    hb_objs=flatten(solveadj.adj_rooms),
    roofs=Toggle(False),
    exposed_floors=toggle_2,
    interior_walls=toggle_2,
    interior_floors=toggle_2)  # -> hb_objs; plug-in component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
aperture = HBAperture(geo=clean_5.SynchronousTree2, rad_mod=glassmod_2)  # -> report, apertures; plug-in component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
addsubface = HBAddSubface(hb_obj=flatten(adiabaticbytype), sub_faces=flatten(aperture.apertures))  # -> hb_obj; plug-in component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
docunits_5 = ConvertToDocumentUnits(ValueString=panel_9)
bordershades = HBExtrudedBorderShades(hb_objs=flatten(addsubface), depth=docunits_5, rad_mod=opaquemod_2)  # -> report, hb_objs; plug-in component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
applymodset = HBApplyModifierSet(rooms=bordershades.hb_objs, mod_set=cluster)  # -> rooms; plug-in component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

# ----
# Automatic opening by WWR
number_slider = Slider(0.4, range=0..1)
facparam = HBFacadeParameters(north=Slider(0.4, range=0..1), east=number_slider, south=Slider(0.4, range=0..1), west=Slider(0.4, range=0..1))  # -> fac_par; plug-in component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
aperturesbyratio = HBAperturesByRatio(hb_objs=flatten(adiabaticbytype), ratio=facparam)  # -> report, hb_objs; plug-in component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

clean_6 = CleanTree(RemoveNulls=True, RemoveInvalid=True, RemoveEmpty=False, Tree=applymodset)

# ----
# Grids
cull_8 = CullPattern(List=graft(layer_name), CullPattern=graft(python_2.is_grid))  # -> simplify(List)
cull_9 = CullPattern(List=geo, CullPattern=python_2.is_grid)
quad_only = Boolean(quadonly)
panel_23 = Panel(cull_8)
clean_7 = CleanTree(RemoveNulls=True, RemoveInvalid=True, RemoveEmpty=True, Tree=cull_8, SynchronousTree1=simplify(cull_9))  # -> Tree, SynchronousTree1
geo_4 = Geometry(graft(clean_7.SynchronousTree1))
name_4 = Text(clean_7.Tree)
rectangle = Rectangle(Plane=PlaneXY(0, 0, 0), XSize=Domain(-1, 1), YSize=Domain(-2, 2), Radius=0)  # -> Rectangle, Length
flip = Flip(Surface=geo_4, Guide=rectangle.Rectangle)  # -> Surface, Result
objatts_2 = ObjectAttributes(ObjectOrAttributes=geo_4)  # -> Name, LayerName, LayerFullPath, Color, MaterialName, LinetypeName, GroupIndices, PlotWeight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
genpts = LBGeneratePointGrid(geometry=flip.Surface, grid_size=grid_size_2, offset_dist=offset, quad_only=quad_only)  # -> points, vectors, face_areas, graft(mesh); plug-in component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

python_6 = GhPythonScript(x=flip.Surface, y="Grid_", z=objatts_2.Name)  # -> out, a; inputs x: list, z: list
# ---------- python_6: Python ----------
__author__ = "mm1013"
__version__ = "2022.08.16"

import rhinoscriptsyntax as rs

o = []
print len(x)
for i in range(0, len(x)):
    if z is not None and z[i] is not None:
        o.append(y + str(i).zfill(2)+ z[i])
    else:
        o.append(y + str(i).zfill(2))
a = o
# ---------- end python_6 ----------
panel_24 = Panel(python_6.a)

sensorgrid = HBSensorGrid(name=python_6.a, positions=genpts.points, directions=genpts.vectors, mesh=genpts.mesh)  # -> grid; plug-in component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
clean_8 = CleanTree(RemoveNulls=True, RemoveInvalid=True, RemoveEmpty=False, Tree=sensorgrid)
panel_25 = Panel(clean_8)

gridrooms = HBSensorGridFromRooms(rooms=applymodset, grid_size=grid_size_2, dist_floor=offset, quad_only=quad_only)  # -> grid, points, mesh; plug-in component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

clean_9 = CleanTree(RemoveNulls=True, RemoveInvalid=True, RemoveEmpty=False, Tree=[clean_8, gridrooms.grid])

# ----
# Assembling model_1 (from rhino)
model = HBModel(rooms=flatten(clean_6), shades=flatten([shade.shades, shade_2.shades]), name=project_name)  # -> report, model; plug-in component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
assigngridsviews = HBAssignGridsAndViews(model=model.model, grids=flatten(clean_9))  # -> model; plug-in component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

# ----
# export model_1 to hbjson
panel_26 = Panel("C:\Users\mm1013\Videos\NLITED\2.2 first hb model")
python_7 = GhPythonScript(model=model.model)  # -> model_name
# ---------- python_7: Python ----------
__author__ = "mm1013"
__version__ = "2022.01.17"

import rhinoscriptsyntax as rs


model_name = model.display_name + "_From_Rhino"
# ---------- end python_7 ----------
dumpobjects = HBDumpObjects(hb_objs=flatten(model.model), name=python_7, folder=panel_26, dump=Button())  # -> report, hb_file; plug-in component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

# ----
# combining model_1 + model_2
merge_models = GhPythonScript(model_1=assigngridsviews, model_2=loadobjects.hb_objs)  # -> out, model
# ---------- merge_models: Python ----------
__author__ = "mm1013"
__version__ = "2022.01.16"

import rhinoscriptsyntax as rs
if model_2 is not None and model_1 is not None:
    model_1_copy = model_1.duplicate()
    model_2_copy = model_2.duplicate()
    model_1_copy.add_model(model_2_copy)
    model = model_1_copy
    
if model_1 is not None and model_2 is None:
    model = model_1

if model_1 is None and model_2 is not None:
    model = model_2
# ---------- end merge_models ----------
assigngridsviews_2 = HBAssignGridsAndViews(model=merge_models.model, grids=flatten(clean_4))  # -> model; plug-in component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
entwine = Entwine(Branch00=genpts.mesh, Branch01=clean_3, FlattenInputs=True)
mjoin = MeshJoin(Meshes=flatten(entwine))

falsestart_2 = LBFalseStartToggle(False)
checkscene = HBCheckScene(hb_objs=flatten(assigngridsviews_2), run=falsestart_2)  # -> report, hdr; plug-in component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
imageviewer = LBImageViewer(ImagePath_=checkscene.hdr, _scale_=1, DisableClickable=False, SaveImgWithCoords=False, scale=1)  # -> ImagePath, Values, GIF

# ----
# Preview materials
model_2 = Data(assigngridsviews_2)
faceradianceattr_2 = HBFaceRadianceAttributes({"Modifier": "properties.radiance.modifier.display_name", "Average Reflectance": "properties.radiance.modifier.average_reflectance", "Average Transmittance": "properties.radiance.modifier.average_transmittance", "Modifier Blk": "properties.radiance.modifier_blk.display_name", "Is Opaque": "properties.radiance.is_opaque", "Dynamic Group": "properties.radiance.dynamic_group_identifier", "State Count": "properties.radiance.state_count", "States": "properties.radiance.states"}, selected="Modifier")
vizwiref = HBVisualizeWireframe(hb_objs=flatten(model_2))  # -> geo; plug-in component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
colorfaceattr_2 = HBColorFaceAttributes(hb_objs=flatten(model_2), attribute=faceradianceattr_2)  # -> mesh, legend, wire_frame, values, colors; plug-in component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
preview = CustomPreview(Geometry=vizwiref, Material=ColourSwatch(SwatchColor=RGB(140, 140, 140)))

# ----
# EXPORT RADIANCE FOLDER
# To more advanced simulations
# OR
# To SpiderRAD Viewer
# Paste the folder to SPIDER VIEWER
# 
# 
# https://www.ladybug.tools/spider-rad-viewer/rad-viewer/r7/rad-viewer.html#https://rawgit.com/ladybug-tools/spider-rad-resources/master/rad-sample-files/various-sources/bristol-clifton-downs.rad
python_8 = GhPythonScript()  # -> local_path; same code as python
falsestart_3 = LBFalseStartToggle(False)
modeltorad = HBModelToRadFolder(model=assigngridsviews_2, folder=python_8, write=falsestart_3)  # -> report, folder; plug-in component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

# ----
# Pollination cloud
dam_2 = DataDam(DataA=assigngridsviews_2, BufferDelay=10000000, BufferMode=0)
param = Data(radpar)
setup_runs = SetupRuns(
    _model=dam_2,
    Cpu_count_=50,
    Grid_filter_="*",
    Min_sen_count_=200,
    Radiance_par_=param,
    Owner="ladybug-tools",
    RecipeJsonString="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",
    project="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")
pollinate = Pollinate(
    _runs=flatten(setup_runs),
    _name_="NLITED_Pollinate_Test",
    CPUNumber=10,
    IfEnabledRemoteRun=False,
    RunLocal=False,
    LBTFolder="C:\Users\mm1013\ladybug_tools",
    liveUpdateStatus=True,
    workingDir="C:\Users\mm1013\simulation")
check_job_status_2 = CheckJobStatus(_job=pollinate, Index_=0, getBothInputOutputAssets=False, liveUpdateStatus=True)
check_run_results_2 = CheckRunResults(
    _run=check_job_status_2,
    recipeSource="https://api.pollination.cloud/registries/ladybug-tools/recipe/daylight-factor/0.7.0")
load_assets_2 = LoadAssets(Asset_1=check_run_results_2, liveUpdateStatus=True, postprocessWithHandler=True, useCachedAssets=True)  # -> Logs, Value_1, Value_2
panel_27 = Panel(load_assets_2.Value_1)
daylight_factor = Number(load_assets_2.Value_1)

# ----
# Daylight factor
param_2 = Data(radpar)
daylightfactor = HBDaylightFactor(model=assigngridsviews_2, radiance_par=param_2, run=and_2)  # -> report, results; plug-in component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

# ----
# Annual Daylight
c_script = CSharpScript(vect=north, run=and_3)  # -> north; inputs vect: Vector3d, run: Boolean
# ---------- c_script: C# usings ----------
using System.Windows.Forms;
# ---------- c_script: C# ----------
    if(run)
    {
      v = vect;
      if(vect.X == 0 && vect.Y > 0.1)
      {
        north = v;
      }
      else
      {
        DialogResult dialogResult = MessageBox.Show("You have a custom north vector! Is that on purpose?\n\nYes: keep it\nNo: use north = y-direction (up in topview)", "North position", MessageBoxButtons.YesNo);
        if(dialogResult == DialogResult.Yes)
        {
          north = v;
        }
        else if (dialogResult == DialogResult.No)
        {

          v = new Vector3d(0, 1, 0);
          north = v;
        }
      }
    }
    else
    {
      north = v;
    }
# ---------- c_script: C# additional code ----------
  Vector3d v = new Vector3d(0, 0, 0);
# ---------- end c_script ----------
param_3 = Data(radpar)
annualdaylight = HBAnnualDaylight(
    model=assigngridsviews_2,
    wea=wea,
    north=c_script,
    thresholds="-t 300",
    schedule=fixedintervalschedule.schedule,
    radiance_par=param_3,
    run=and_3)  # -> report, results, DA, cDA, UDI, UDI_low, UDI_up; plug-in component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

panel_28 = Panel(annualdaylight.results)
filter_2 = StreamFilter(Gate=simulation_type_6, Stream0=daylightfactor.results, Stream1=annualdaylight.DA)

model_3 = Data(assigngridsviews_2)
export = LBFalseStartToggle(False)
python_9 = GhPythonScript()  # -> local_path; same code as python

# ----
# a new model without apertures
panel_29 = Panel("RadianceExport_Advanced")
python_10 = GhPythonScript(x=model_3)  # -> out, a
# ---------- python_10: Python ----------
__author__ = "mm1013"
__version__ = "2022.08.16"

import rhinoscriptsyntax as rs

v = x.duplicate()
v.remove_all_apertures()
a = v
# ---------- end python_10 ----------
bool = Boolean(export)
folder = Text(python_9)
concat = Concatenate(FragmentA=folder, FragmentB=panel_29)
panel_30 = Panel(concat)
modeltorad_2 = HBModelToRadFolder(model=python_10.a, folder=panel_30, write=bool)  # -> report, folder; plug-in component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

default = DefaultMSS(data=flatten(bool), default_value_flattened=flatten(modeltorad_2.report))

# ----
# Advanced export - requires HoneybeePlus
# This is a tweaked export to seperate the apertures from the rest of the building.
# This will help when doing manual multiphase simulations as per Eleonoras tutorial
# export apertures as stand alone rad files
python_11 = GhPythonScript(x=model_3)  # -> out, wins
# ---------- python_11: Python ----------
__author__ = "mm1013"
__version__ = "2022.08.16"

import rhinoscriptsyntax as rs

wins = [v for v in x.shades if not v.properties.radiance.is_opaque]
#shades = [v for v in x.shades if v.properties.radiance.is_opaque]
# ---------- end python_11 ----------
python_12 = GhPythonScript(x=python_11.wins)  # -> name, modifier
# ---------- python_12: Python ----------
__author__ = "mm1013"
__version__ = "2022.08.16"

import rhinoscriptsyntax as rs

name = x.properties.radiance.modifier.identifier
modifier = x.properties.radiance.modifier
# ---------- end python_12 ----------
vizall = HBVisualizeAll(hb_objs=flatten(python_11.wins))  # -> geo; plug-in component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
cset_2 = CreateSet(List=python_12.name)  # -> graft(Set), Map
assign_paths_2 = AssignPaths(InputData=flatten(python_12.name), PathsToAssign=flatten(cset_2.Map))
assign_paths_3 = AssignPaths(InputData=flatten(vizall), PathsToAssign=flatten(cset_2.Map))
item_4 = ListItem(List=assign_paths_2, Index=0, Wrap=True)
python_13 = GhPythonScript(x=item_4)  # -> out, a
# ---------- python_13: Python ----------
__author__ = "mm1013"
__version__ = "2022.08.16"

import rhinoscriptsyntax as rs

a = float(x.split("_")[-1])
# ---------- end python_13 ----------
division_2 = Division(A=python_13.a, B=100)
radglassmat = HoneybeePlus_RadianceGlassMaterial(name=graft(cset_2.Set), t_vis=graft(division_2))  # -> graft(material); plug-in component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
concat_2 = Concatenate(FragmentA=cset_2.Set, FragmentB=".rad")
hbwinsrf = HoneybeePlus_HoneybeeWindowSurface(geo=assign_paths_3, names=cset_2.Set, rad_mat=radglassmat)  # -> report, HB_win_srf; plug-in component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
concat_3 = Concatenate(FragmentA=concat, FragmentB="\model\aperture\")
hbtorad = HoneybeePlus_WriteHBObjectsToRadiance(HB_objects=hbwinsrf.HB_win_srf, folder=concat_3, file_name=concat_2, write=default)  # -> rad_file; plug-in component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

panel_31 = Panel(concat_3)

assigngridsviews_3 = HBAssignGridsAndViews(model=assigngridsviews_2, views=flatten(viewport))  # -> model; plug-in component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
ciesky = HBCIEStandardSky(
    north=north,
    location=importloc,
    month=Slider(3, range=1..12),
    day=Slider(21, range=1..22),
    hour=Slider(12, range=0..23),
    type=0)  # -> sky; plug-in component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
param_4 = Data(radpar)

# ----
# Point in Time
pitgrid = HBPointInTimeGridBased()  # -> report, results; plug-in component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
pitview = HBPointInTimeViewBased(model=assigngridsviews_3, sky=ciesky, metric=metric, radiance_par=param_4, run=and)  # -> report, results; plug-in component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

panel_32 = Panel(pitview.results)

glare = HBGlarePostprocess(hdr=pitview.results)  # -> DGP, category, glare_indices, check_hdr; plug-in component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
falsecolor = HBFalseColor(hdr=pitview.results, contour_lines=Toggle(True))  # -> hdr; plug-in component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
adjusthdr = HBAdjustHDR(hdr=falsecolor, adj_expos=Toggle(True))  # -> hdr; plug-in component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
hdr_gif = HBHDRToGIF(hdr=adjusthdr)  # -> gif; plug-in component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
imageviewer_2 = LBImageViewer(ImagePath_=falsecolor, _scale_=1, DisableClickable=False, SaveImgWithCoords=False, scale=1)  # -> ImagePath, Values, GIF
panel_33 = Panel(hdr_gif)

panel_34 = Panel(glare.category)
panel_35 = Panel(glare.DGP)
panel_36 = Panel(imageviewer_2.Values)

# ----
# Cycle through the annual results
shift = ShiftList(List=annualdaylight.results, Shift=-1, Wrap=False)
file = ReadFile(File=shift, PerLineParse=True)  # -> flatten(Content)
legendpar_3 = LBLegendParameters(min="0", max="2000")  # -> leg_par; plug-in component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
c_script_2 = CSharpScript(x=file, y=Slider(3299, range=0..4000))  # -> out, A, B; inputs x: list of String, y: Int32
# ---------- c_script_2: C# usings ----------
using System.Linq;
# ---------- c_script_2: C# ----------
    List<double> outDoubles = new List<double>();
    List<string> outStrings = new List<string>();
   
    foreach(string pt in x)
    {
      outStrings.Add(pt.Split(' ').Where(s => !String.IsNullOrEmpty(s)).Skip(y).FirstOrDefault());




      outDoubles.Add(double.Parse(outStrings[outStrings.Count - 1]));


    }
    B = outStrings;
    A = outDoubles;
# ---------- end c_script_2 ----------
expression_3 = Expression(x=c_script_2.A, Expression="Format(\"{0:0}\", x)")
panel_37 = Panel(c_script_2.B)
panel_38 = Panel(c_script_2.A)
docunits_6 = ConvertToDocumentUnits(ValueString="100mm")

# ----
# Visualize
# Results
panel_39 = Panel("Daylight Factor (%)")
getgridsviews_3 = HBGetGridsAndViews(model=assigngridsviews_2)  # -> views, grids, points, meshes; plug-in component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
# GRID BASED RESULTS
values = Data(flatten(filter_2))
mesh = Mesh(flatten(getgridsviews_3.meshes))
c_script_3 = CSharpScript(inResults=values)  # -> outResults; inputs inResults: list of Double
# ---------- c_script_3: C# ----------
    if (inResults != null && inResults.Count > 1)
    {
      results = inResults;
    }

    outResults = results;
# ---------- c_script_3: C# additional code ----------
  List<double> results = new List<double>();
# ---------- end c_script_3 ----------
mjoin_2 = MeshJoin(Meshes=mesh)

filter_3 = StreamFilter(Gate=simulation_type_7, Stream0=panel_39, Stream1="Daylight Autonomy (%)")
mjoin_3 = MeshJoin(Meshes=flatten(mesh))
move = Move(Geometry=mjoin_3, Motion=Z)  # -> Geometry, Transform

facen = FaceNormals(Mesh=move.Geometry)  # -> Centers, Normals
heatmap = LBSpatialHeatmap(values=c_script_2.A, mesh=move.Geometry, legend_par=legendpar_3)  # -> mesh, legend, title, colors, legend_par; plug-in component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
tag = TextTag3D(
    Location=facen.Centers,
    Text=expression_3,
    Size=docunits_6,
    Colour=ColourSwatch(SwatchColor=RGB(0, 0, 0)),
    Justification=5)

heatmap_2 = LBSpatialHeatmap(values=flatten(c_script_3), mesh=flatten(mjoin_3), legend_par=filter, legend_title=filter_3)  # -> mesh, legend, title, colors, legend_par; plug-in component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

expression_4 = Expression(x=c_script_3, Expression="Format(\"{0:0}\", x)")
expression_5 = Expression(x=c_script_3, Expression="Format(\"{0:0.0}\", x)")
facen_2 = FaceNormals(Mesh=mjoin_2)  # -> Centers, Normals
filter_4 = StreamFilter(Gate=simulation_type_9, Stream0=expression_5, Stream1=expression_4)
tag_2 = TextTag3D(Location=facen_2.Centers, Text=filter_4, Size=docunits_4, Colour=ColourSwatch(SwatchColor=RGB(0, 0, 0)), Justification=5)

# ----
# Average DF pr room
simulation_type_11 = Integer(simulation_type)
mesh_explode = MeshExplode(m=mjoin_2)  # -> out, simplify(A)
# ---------- mesh_explode: VB usings ----------
Imports System.IO
Imports System.Linq
Imports System.Data
Imports System.Drawing
Imports System.Reflection
Imports System.Windows.Forms
Imports System.Xml
Imports System.Xml.Linq
Imports Microsoft.VisualBasic
Imports System.Runtime.InteropServices

Imports Rhino.DocObjects
Imports Rhino.Collections
Imports GH_IO
Imports GH_IO.Serialization
# ---------- mesh_explode: VB ----------
    Component.Params.Input(0).Name = "Mesh"
    Component.Params.Input(0).Description = "Open or closed mesh"

    Component.Params.Output(1).Name = "Mesh"
    Component.Params.Output(1).Description = "If successful, a valid mesh"

    If m IsNot Nothing Then
      Dim pts As Rhino.Geometry.Collections.MeshVertexList
      Dim faces As Rhino.Geometry.Collections.MeshFaceList
      Dim clrs As Rhino.Geometry.Collections.MeshVertexColorList
      Dim i As Integer
      Dim mshs As New list(Of mesh)

      faces = m.Faces
      pts = m.Vertices
      If m.VertexColors.count() = 0 Then m.VertexColors.CreateMonotoneMesh(color.FromArgb(100, 100, 100))
      clrs = m.VertexColors

      For i = 0 To faces.count() - 1 Step 1
        Dim fc As New meshFace
        Dim face As New MeshFace
        Dim ptList As New list(Of point3d)
        Dim clrList As New list(Of color)
        Dim msh As New mesh

        face = faces(i)

        ptList.add(New point3d(pts(face.A)))
        ptList.add(New point3d(pts(face.B)))
        ptList.add(New point3d(pts(face.C)))
        If face.IsQuad Then ptList.add(New point3d(pts(face.D)))

        clrList.add(clrs(face.A))
        clrList.add(clrs(face.B))
        clrList.add(clrs(face.C))
        If face.IsQuad Then clrList.add(clrs(face.D))

        If face.IsQuad Then fc = New meshFace(0, 1, 2, 3) Else fc = New meshface(0, 1, 2)

        msh.Vertices.AddVertices(ptList.toarray())
        msh.Faces.AddFace(fc)
        msh.VertexColors.SetColors(clrList.toarray())
        mshs.add(msh)
      Next

      A = mshs
    End If
# ---------- end mesh_explode ----------
facen_3 = FaceNormals(Mesh=mesh)  # -> Centers, Normals
unflatten = UnflattenTree(Tree=mesh_explode.A, Guide=facen_3.Centers)
unflatten_2 = UnflattenTree(Tree=c_script_3, Guide=facen_3.Centers)
area = Area(Geometry=unflatten)  # -> Area, Centroid
avr = Average(Input=area.Centroid)
wav = WeightedAverage(Input=unflatten_2, Weights=area.Area)
expression_6 = Expression(x=wav, Expression="Format(\"Average DF {0:0.0}%\", x)")
docunits_7 = ConvertToDocumentUnits(ValueString="400mm")
panel_40 = Panel(expression_6)

# ----
# Floor area above xxx DA/DF
mesh_explode_2 = MeshExplode(m=mjoin_2)  # -> out, simplify(A); same code as mesh_explode
facen_4 = FaceNormals(Mesh=mesh)  # -> Centers, Normals
unflatten_3 = UnflattenTree(Tree=c_script_3, Guide=facen_4.Centers)
unflatten_4 = UnflattenTree(Tree=mesh_explode_2.A, Guide=facen_4.Centers)
larger = LargerThan(FirstNumber=unflatten_3, SecondNumber=item_2)  # -> LargerThan, OrEqualTo
cull_10 = CullPattern(List=unflatten_4, CullPattern=larger.LargerThan)
area_2 = Area(Geometry=unflatten_4)  # -> Area, Centroid
area_3 = Area(Geometry=cull_10)  # -> Area, Centroid
ma = MassAddition(Input=area_2.Area)  # -> Result, PartialResults
ma_2 = MassAddition(Input=area_3.Area)  # -> Result, PartialResults
division_3 = Division(A=ma_2.Result, B=ma.Result)
multiplication = Multiplication(A=division_3, B=100)
mjoin_4 = MeshJoin(Meshes=cull_10)
expression_7 = Expression(x=multiplication, y=item_2, z=item_3, Expression="Format(\"Floor area above {2}{1}: {0:0.0}%\", x, y, z)")
medges = MeshEdges(Mesh=mjoin_4)  # -> NakedEdges, InteriorEdges, NonManifoldEdges
crv = Curve(medges.NakedEdges)
docunits_8 = ConvertToDocumentUnits(ValueString="300mm")
preview_2 = CustomPreview(Geometry=crv, Material=ColourSwatch(SwatchColor=RGB(255, 255, 255)))
tag_3 = TextTag3D(Location=avr, Text=expression_7, Size=docunits_8, Colour=ColourSwatch(SwatchColor=RGB(0, 0, 0)), Justification=5)
panel_41 = Panel(expression_7)

filter_5 = StreamFilter(Gate=simulation_type_11, Stream0=avr)

tag_4 = TextTag3D(Location=filter_5, Text=expression_6, Size=docunits_7, Colour=ColourSwatch(SwatchColor=RGB(0, 0, 0)), Justification=5)

# ==== cluster Cluster
# Default modifiers
panel = Panel("HB_Exterior_Wall_50")
opaquemod = HBOpaqueModifier(name="HB_Inner_Wall_50", reflect="0.5")  # -> modifier; plug-in component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
opaquemod_2 = HBOpaqueModifier(name=panel, reflect="0.5")  # -> modifier; plug-in component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
opaquemod_3 = HBOpaqueModifier(name="HB_Ceilings_70", reflect="0.7")  # -> modifier; plug-in component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
opaquemod_4 = HBOpaqueModifier(name="HB_Floors_20", reflect="0.2")  # -> modifier; plug-in component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
interiorsubset = HBInteriorModifierSubset(interior_wall=opaquemod, ceiling=opaquemod_3, interior_floor=opaquemod_4)  # -> interior_set; plug-in component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
shadesubset = HBShadeModifierSubset(exterior_shade=opaquemod_2)  # -> shade_set; plug-in component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
exteriorsubset = HBExteriorModifierSubset(exterior_wall=opaquemod_2, exterior_roof=opaquemod_3, exposed_floor=opaquemod_4)  # -> exterior_set; plug-in component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
modifierset = HBModifierSet(name="Standard_Compliance", exterior_subset=exteriorsubset, interior_subset=interiorsubset, shade_subset=shadesubset)  # -> mod_set; plug-in component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
mod_set = ClusterOutput(modifierset)

# ==== cluster DefaultMSS
default_value_flattened = ClusterInput()
data = ClusterInput()
data_2 = Data(data)
merge = Merge(Data1=flatten(data_2), Data2="0")  # -> flatten(Result)
default_value_flattened_2 = Data(flatten(default_value_flattened))
lng = ListLength(List=merge)
equals = Equality(FirstNumber=lng, SecondNumber="1")  # -> Equality, Inequality
cull = CullPattern(List=data_2, CullPattern=invert(equals.Equality))
panel = Panel(equals.Equality)
cull_2 = CullPattern(List=default_value_flattened_2, CullPattern=equals.Equality)
data_3 = Data([cull, cull_2])
data_4 = ClusterOutput(data_3)
