# Grasshopper definition HB Model daylight.gh (Grasshopper 1.0.7)
# Copyright: 2021
# Copyright: 2022-14-37
# Copyright: 2023-26-23
# Copyright: Henning Larsen Architects 2015
# plug-ins: Human, HDTTreeUtils, LadybugGrasshopper, PollinationGH, MantaRay

python = GhPythonScript(filename="DNK_DRY_OFFICIAL_2001-2010_epw-fil.epw")  # -> local_path
# ---------- python: Python ----------
__author__ = "mm1013"
__version__ = "2022.08.16"

import rhinoscriptsyntax as rs
if filename is not None:
    local_path = "\\".join(ghdoc.Path.split("\\")[:-1]) + "\\" + filename
else:
    local_path = "\\".join(ghdoc.Path.split("\\")[:-1]) + "\\"
# ---------- end python ----------

# ----
# Last updated
project_name = Panel("Sample_Project_001")

# ----
# Get sublayer items
panel = Panel("Daylight_Inputs::*")
panel_2 = Panel("""Mesh
Polysurface
Surface
Extrusion""")
dpipeline = DynamicGeometryPipeline(
    LayerFilter=panel,
    TypeFilter=panel_2,
    NameFilter="*",
    GroupByLayer=False,
    GroupByType=False,
    IncludeHidden=True,
    IncludeLocked=True,
    enableFullPath=True,
    listenToAttributes=True)

# ----
# Radiance parameters
simulation_type = ValueList({"Daylight Factor": 0, "Daylight Autonomy": 1, "Point in Time (VIEW)": 2}, selected="Daylight Autonomy")
ambient_bounces = ValueList({"Direct Sun Only": 0, "Sky only, ab 1": 1, "low, ab 3": 3, "medium, ab 5": 5, "high, ab 7": 7, "mega high, ab 9": 9}, selected="Sky only, ab 1")
detail_level = ValueList({"Low": 0, "Medium": 1, "High": 2}, selected="Medium")

# ----
# Grid setup
grid_size = Panel("1m")
vertical_offset = Panel("0.75m")
quadonly = BooleanToggle(False)
docunits = ConvertToDocumentUnits(ValueString=vertical_offset)
docunits_2 = ConvertToDocumentUnits(ValueString=grid_size)

mesh = Mesh([<mesh referenced from the Rhino model> x673])
decks_1_0 = DECKS10(mesh=mesh)  # -> mesh_floor_2, mesh_wall_2, mesh_ceiling_2
mesh_2 = Mesh(decks_1_0.mesh_ceiling_2)
mesh_3 = Mesh(decks_1_0.mesh_wall_2)
mesh_4 = Mesh(decks_1_0.mesh_floor_2)

# ----
# Find largest faces for windows
mesh_5 = Mesh([<mesh referenced from the Rhino model> x420])
brep = Brep()
largest_brep = LargestBREP(window_breps=brep)
cluster = Cluster_2(M=mesh_5)
grp = Group(cluster)
grp_2 = Group(largest_brep)

# ----
# Start the simulation
run = LBFalseStartToggle(False)

# ----
# Inputs for point in time
# Will update to active rhino view
# whenever you change the type
viewtype = ValueList({"* 0 Perspective (v)": 0, "* 1 Hemispherical fisheye (h)": 1, "* 2 Parallel (l)": 2, "* 3 Cylindrical panorama (c)": 3, "* 4 Angular fisheye (a)": 4, "* 5 Planisphere [stereographic] projection (s)": 5}, selected="* 4 Angular fisheye (a)")
metric = ValueList({"* 0  illuminance": 0, "* 1  irradiance": 1, "* 2  luminance": 2, "* 3  radiance": 3}, selected="* 2  luminance")
viewport = HBViewFromViewport(name="FromRhino", view_type=viewtype, refresh=run)  # -> view; plug-in component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

# ----
# DISCLAIMER:
# The Annual Daylight Autonomy is NOT using any dynamic blinds
# 
# This may be updated when newer versions of LBT supports it.
# 
# Take a look at https://github.com/Sonderwoods/NLITED for updates / bugfixes etc.
# create layers
panel_3 = Panel("Daylight_Inputs::")
panel_4 = Panel("""HB_Rooms
Grids
Walls_50
Ground_10
Floor_20
Ceilings_70
Frames_70
Doors_60
Context_30
Windows_70%""")
merge = Merge(
    Data1=ColourSwatch(SwatchColor=RGB(84, 24, 62)),
    Data2=ColourSwatch(SwatchColor=RGB(255, 20, 169)),
    Data3=ColourSwatch(SwatchColor=RGB(54, 135, 86)),
    Data4=ColourSwatch(SwatchColor=RGB(148, 113, 106)),
    Data5=ColourSwatch(SwatchColor=RGB(178, 70, 48)),
    Data6=ColourSwatch(SwatchColor=RGB(235, 185, 94)),
    Data7=ColourSwatch(SwatchColor=RGB(216, 235, 94)),
    Data8=ColourSwatch(SwatchColor=RGB(87, 189, 90)),
    Data9=ColourSwatch(SwatchColor=RGB(105, 125, 84)),
    Data10=ColourSwatch(SwatchColor=RGB(92, 169, 181)))
concat = Concatenate(FragmentA=panel_3, FragmentB=panel_4)
createlayer = CreateLayer(full_path=concat, color=merge, run=Button())  # -> out, layerName, layerIndex; inputs color: Color, run: Boolean
# ---------- createlayer: Python ----------
__author__ = "mm1013"
__version__ = "2021.11.18"

import Rhino.Geometry as rg
import Rhino.RhinoDoc as rhdoc
import Rhino.DocObjects as docobj
doc = rhdoc.ActiveDoc



def _get_layer(layer_name):
    """Get a layer index from the Rhino document from the layer name."""
    layer_table = doc.Layers  # layer table
    layer_index = layer_table.FindByFullPath(layer_name, True)
    combined_part_names = []
    if layer_index < 0:
        
        part_names = layer_name.split("::") #  full name could be layer::sublayer::sublayer

        for i in range(len(part_names)):
            print i
            combined_part_names.append("::".join(part_names[0:i+1])) #  [0] = layer ,  [1] = layer::sublayer, [2] = layer::sublayer::sublayer
            print combined_part_names
            checking_index = layer_table.FindByFullPath(combined_part_names[i], True)
            if  checking_index < 0:  # layer::sublayer doesnt exist:
                print combined_part_names[i] + " was not found"
                
                parent_layer = docobj.Layer()
                parent_layer.Name = part_names[i]
                print combined_part_names[i]
                if i > 0:
                    parent_layer.ParentLayerId = prev_layer.Id # nesting it to previosly created layer
                layer_index = layer_table.Add(parent_layer)
                prev_layer = doc.Layers[layer_index]
            else:
                
                prev_layer = doc.Layers[checking_index]
                
                
                print combined_part_names[-1] + " was found"
    
    if color != None:
        doc.Layers[layer_index].Color = color
    return layer_name, layer_index
    
    
  
if run:
    a = _get_layer(full_path)
    layerName = a[0]
    layerIndex = a[1]
# ---------- end createlayer ----------

txt = Text(python)

# ----
# Weather data
panel_5 = Panel("https://energyplus-weather.s3.amazonaws.com/europe_wmo_region_6/FRA/FRA_Marseille.076500_IWEC/FRA_Marseille.076500_IWEC.zip")
falsestart = LBFalseStartToggle(False)
epwmap = LBEPWmap(epw_map=falsestart)  # -> report; plug-in component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
downloadepw = LBDownloadWeather(weather_URL=panel_5)  # -> epw_file, stat_file, ddy_file; plug-in component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
importloc = LBImportLocation(epw_file=txt)  # -> location; plug-in component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
wea = HBWeaFromEPW(epw_file=txt)  # -> wea; plug-in component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
panel_6 = Panel(importloc)

# ----
# Remember to
# update the dam!
dam = DataDam(DataA=dpipeline, BufferDelay=10000000, BufferMode=0)

# ----
# Sort by layer
objatts = ObjectAttributes(ObjectOrAttributes=dam)  # -> Name, LayerName, LayerFullPath, Color, MaterialName, LinetypeName, GroupIndices, PlotWeight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
cset = CreateSet(List=objatts.LayerName)  # -> Set, Map
assign_paths = AssignPaths(InputData=flatten(dam), PathsToAssign=flatten(cset.Map))
python_2 = GhPythonScript(layer_name=graft(cset.Set))  # -> is_opaque, is_transparent, is_grid, is_HB_Room, is_HB_Window
# ---------- python_2: Python ----------
__author__ = "mm1013"
__version__ = "2022.01.16"

import rhinoscriptsyntax as rs

is_grid = layer_name == "Grids"

if layer_name.startswith("HB_"):
    is_opaque = is_transparent = is_grid = False
    
    is_HB_Window = layer_name.endswith("%")
    is_HB_Room = layer_name == "HB_Rooms"
    
    
else:
    is_HB_Room = False
    is_HB_Window = False
    if is_grid:
        is_opaque = False
        
        is_transparent = False
    else:
        is_transparent = layer_name.endswith("%")
        if is_transparent:
            transmittance = layer_name.split("_")[-1].replace("%","")
        is_opaque = not is_transparent
# ---------- end python_2 ----------
layer_name = Text(cset.Set)
geo = Geometry(assign_paths)

falsestart_2 = LBFalseStartToggle(False)
python_linkajou = PythonLinkajou(run=falsestart_2)  # -> mats, layerNames; inputs run: Boolean
# ---------- python_linkajou: Python ----------
import rhinoscriptsyntax as rs

import clr
#clr.AddReference('Linkajou')
clr.AddReference('ClimateStudioLib')

#import Linkajou
import ClimateStudioLib
from System.Collections import *
import System
import Rhino

#clr.ImportExtensions(Linkajou.Extensions)




pathToMaterials = "Z:\\LINK IO - Parametrisk Design\\GrasshopperInstallation\\Backstage\\ClimateStudio\Materials\\"


layerNames = []

# c#.net list
mats = System.Collections.Generic.List[ClimateStudioLib.Materials.LightingMaterial]()


for layer in Rhino.RhinoDoc.ActiveDoc.Layers:

    print "trying %s" % layer.Name
    #REJECTIONS

    if layer.Name is None or layer.Name == "":
        continue
    

    if not layer.FullPath.startswith("Daylight_Inputs::"):
        continue
    
    #print layer.Name.split('_')
    if len(layer.Name.split('_')) < 2:
        continue

    splits = layer.Name.split('_')
    print splits[-1]
    
    try:
        x = float(splits[-1].replace("%", ""))
        #continue
    except:
        pass
    
    
    print "parsing %s" % layer.Name
    
    #PARSING

    val = int(layer.Name.split('_')[-1].replace("%", ""))

    #Dynamic hax
    #Rhino.DocObjects.Custom.SharedUserDictionary is hidden!?
    dict = layer.UserData[0].Dictionary
    #Rhino.Collections.ArchivableDictionary dict = ud.Dictionary;

    isGlass = layer.Name[-1] == '%'
    prefix = None
    
    if isGlass:
        prefix = "ZZ_Glass_%s" % val
    else:
        prefix = "ZZ_Opaque_%s" % val

  

    c = int(val * 255.0 / 100.0)


    #/ClimateStudioLib.Materials.LightingMaterial lightmat = ClimateStudioLib.Materials.LightingMaterial.FromByteArray(dict.GetBytes("CS_LightingMaterial"));

    if run:
        radMat = ClimateStudioLib.Radiance.RadianceMaterial.FromRadFile(pathToMaterials + prefix + ".rad")
        _mat = ClimateStudioLib.Materials.LightingMaterial.FromRadianceMaterial(radMat)
        if isGlass:
        
            dict.Set("CS_MaterialName", "ZZ_Glass_%s" % val)
        
        else:
        
            dict.Set("CS_MaterialName", "ZZ_Opaque_%s" % val)
        
        
        dict.Set.Overloads[System.String, System.Collections.Generic.IEnumerable[System.Byte]]("CS_LightingMaterial", _mat.ToByteArray())
        dict.Set("CS_MaterialColor", System.Drawing.Color.FromArgb(255, c, c, c))
      


    mats.Add(ClimateStudioLib.Materials.LightingMaterial.FromByteArray(dict.GetBytes("CS_LightingMaterial")))
    layerNames.Add(layer.Name)




mat = mats
ln = layerNames
# ---------- end python_linkajou ----------
setcsmats = CSharpScript(Reference="C:\Program Files\Solemma\ClimateStudio\bin\ClimateStudioLib.dll")  # -> mat, ln; inputs run: Boolean; disabled
# ---------- setcsmats: C# usings ----------
using System.Linq;
using ClimateStudioLib;
using System.Text;
using System.Reflection;
# ---------- setcsmats: C# ----------
    // Assuming that all your geometry is:
    // - On sublayers to the "Daylight_Inputs" layer
    // - starting with a "_"
    // - spelled like "_HelloOpaque_50" or "_HelloGlass_50%"



    string pathToMaterials = @"Z:\LINK IO - Parametrisk Design\GrasshopperInstallation\Backstage\ClimateStudio\Materials\";

    List<string> layerNames = new List<string>();

    List<ClimateStudioLib.Materials.LightingMaterial> mats = new List<ClimateStudioLib.Materials.LightingMaterial>();

    foreach (Rhino.DocObjects.Layer layer in Rhino.RhinoDoc.ActiveDoc.Layers)
    {
      // REJECTIONS

      if(String.IsNullOrEmpty(layer.Name)) continue;


      if(!layer.FullPath.StartsWith("Daylight_Inputs::")) continue;

      if(!layer.Name.StartsWith("_")) continue;

      if(layer.Name.Split('_').Length < 3) continue;

      string[] splits = layer.Name.Split('_');
      double x = 0;
      if(!double.TryParse(splits[splits.Length - 1].Replace("%", ""), out x))
      {
        continue;
      }

      // PARSING

      int val = int.Parse(layer.Name.Split('_').Last().Replace("%", ""));

      //Dynamic hax
      //Rhino.DocObjects.Custom.SharedUserDictionary is hidden!?
      dynamic ud = (dynamic)layer.UserData[0];
      Rhino.Collections.ArchivableDictionary dict = ud.Dictionary;

      bool isGlass = layer.Name.ToCharArray().Last() == '%';
      string prefix = null;
      if(isGlass)
      {
        prefix = String.Format("ZZ_Glass_{0}", val);

      }
      else
      {
        prefix = String.Format("ZZ_Opaque_{0}", val);

      }

      int c = (int) (val * 255.0 / 100.0);


      //ClimateStudioLib.Materials.LightingMaterial lightmat = ClimateStudioLib.Materials.LightingMaterial.FromByteArray(dict.GetBytes("CS_LightingMaterial"));

      if(run)
      {

        ClimateStudioLib.Radiance.RadianceMaterial radMat = ClimateStudioLib.Radiance.RadianceMaterial.FromRadFile(pathToMaterials + prefix + ".rad");
        ClimateStudioLib.Materials.LightingMaterial _mat = ClimateStudioLib.Materials.LightingMaterial.FromRadianceMaterial(radMat);
        if(isGlass)
        {
          dict.Set("CS_MaterialName", String.Format("ZZ_Glass_{0}", val));
        }
        else
        {
          dict.Set("CS_MaterialName", String.Format("ZZ_Opaque_{0}", val));
        }
        
        dict.Set("CS_LightingMaterial", _mat.ToByteArray());
        dict.Set("CS_MaterialColor", System.Drawing.Color.FromArgb(255, c, c, c));
      }


      mats.Add(ClimateStudioLib.Materials.LightingMaterial.FromByteArray(dict.GetBytes("CS_LightingMaterial")));
      layerNames.Add(layer.Name);


    }

    mat = mats;
    ln = layerNames;
# ---------- end setcsmats ----------
python_3 = GhPythonScript()  # -> out, bitmaps; inputs geos: list of GeometryBase, run: Boolean, refresh: tree; disabled
# ---------- python_3: Python ----------
import clr
clr.AddReference('Linkajou')

import Linkajou
from System.Collections import *
import System
import Rhino

clr.ImportExtensions(Linkajou.Extensions)

if (run):
    
    bitmaps = []
    
    view = Rhino.RhinoDoc.ActiveDoc.Views.Add("tempView2", Rhino.Display.DefinedViewportProjection.Perspective, System.Drawing.Rectangle(100, 10, 1000, 1000), True);
    
    
    modes = Rhino.Display.DisplayModeDescription.GetDisplayModes()
    
    for mode in modes:
        Rhino.RhinoApp.WriteLine(mode.EnglishName.ToString())
        if mode.EnglishName.ToLower() == "wireframe black":
            view.ActiveViewport.DisplayMode = mode
            mode.DisplayAttributes.ShowSurfaceEdges = True
            
            break
            
    
    
    
    for geo in geos:
        b = System.ValueTuple[Rhino.Geometry.GeometryBase, Rhino.DocObjects.ObjectAttributes, bool](geo, None, True)
        #a[0] = geo
        g = System.Collections.Generic.List[System.ValueTuple[Rhino.Geometry.GeometryBase, Rhino.DocObjects.ObjectAttributes, bool]]()
        g.Add(b)
        bitmaps.append(Linkajou.Helpers.Geometry.ScreenCaptureHelper.GetBitmap(g, 1500,1800, view, None, None, True) )
        
    view.Close()
# ---------- end python_3 ----------

# ----
# Opaque objects
cull = CullPattern(List=graft(layer_name), CullPattern=graft(python_2.is_opaque))  # -> simplify(List)
cull_2 = CullPattern(List=geo, CullPattern=graft(python_2.is_opaque))  # -> simplify(List)
panel_7 = Panel(cull)
python_4 = GhPythonScript(layer_name=panel_7)  # -> out, reflectance
# ---------- python_4: Python ----------
__author__ = "mm1013"
__version__ = "2022.01.16"

import rhinoscriptsyntax as rs
try:
    reflectance = layer_name.split("_")[-1]
    
except:
    reflectance = None
# ---------- end python_4 ----------
clean = CleanTree(
    RemoveNulls=True,
    RemoveInvalid=True,
    RemoveEmpty=True,
    Tree=cull,
    SynchronousTree1=cull_2,
    SynchronousTree2=python_4.reflectance)  # -> Tree, SynchronousTree1, SynchronousTree2
refl = Number(expr("x/100", clean.SynchronousTree2))
geo_2 = Geometry(clean.SynchronousTree1)
name = Text(clean.Tree)
opaquemod = HBOpaqueModifier(name=name, reflect=refl)  # -> modifier; plug-in component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
shade = HBShade(geo=geo_2, name=name, rad_mod=opaquemod)  # -> report, shades; plug-in component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

# ----
# Transparent objects
cull_3 = CullPattern(List=graft(layer_name), CullPattern=graft(python_2.is_transparent))  # -> simplify(List)
cull_4 = CullPattern(List=geo, CullPattern=python_2.is_transparent)
panel_8 = Panel(cull_3)
python_5 = GhPythonScript(layer_name=cull_3)  # -> out, transmittance, name
# ---------- python_5: Python ----------
__author__ = "mm1013"
__version__ = "2022.01.16"

import rhinoscriptsyntax as rs

try:
    transmittance = layer_name.split("_")[-1].replace("%","")
    name = layer_name.replace("%","")
except:
    transmittance = None
    name = None
# ---------- end python_5 ----------
clean_2 = CleanTree(
    RemoveNulls=True,
    RemoveInvalid=True,
    RemoveEmpty=True,
    Tree=simplify(cull_4),
    SynchronousTree1=simplify(python_5.name),
    SynchronousTree2=simplify(python_5.transmittance))  # -> Tree, SynchronousTree1, SynchronousTree2
transmittance = Number(expr("x/100", clean_2.SynchronousTree2))
name_2 = Text(clean_2.SynchronousTree1)
geo_3 = Geometry(clean_2.Tree)
glassmod = HBGlassModifier(name=name_2, trans=transmittance)  # -> modifier; plug-in component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
faceradianceattr = HBFaceRadianceAttributes({"Modifier": "properties.radiance.modifier.display_name", "Average Reflectance": "properties.radiance.modifier.average_reflectance", "Average Transmittance": "properties.radiance.modifier.average_transmittance", "Modifier Blk": "properties.radiance.modifier_blk.display_name", "Is Opaque": "properties.radiance.is_opaque", "Dynamic Group": "properties.radiance.dynamic_group_identifier", "State Count": "properties.radiance.state_count", "States": "properties.radiance.states"}, selected="Average Transmittance")
shade_2 = HBShade(geo=geo_3, name=name_2, rad_mod=glassmod)  # -> report, shades; plug-in component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
colorfaceattr = HBColorFaceAttributes(hb_objs=flatten(shade_2.shades), attribute=faceradianceattr)  # -> mesh, legend, wire_frame, values, colors; plug-in component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

grid_size_2 = Number(docunits_2)
offset = Number(docunits)
python_6 = GhPythonScript(bmp2=python_3.bitmaps)  # -> out, pdfDoc; inputs i: Int32; disabled
# ---------- python_6: Python ----------
__author__ = "mm1013"
__version__ = "2023.08.04"

import clr
clr.AddReference('Linkajou')

import Linkajou
from System.Collections import *
import System
import Rhino
from Linkajou.Pdf import *

clr.ImportExtensions(Linkajou.Extensions)


if i == 0:
    doc.Pages.Clear()
    
    
page = Linkajou.Pdf.Page()

header = Linkajou.Pdf.PdfText(name, 25, 270, 12, "Montserrat")
page.Content.Add(header)

image = PdfBitmap(bmp, 12, 250, 130, 130, PdfBitmap.FillMode.Stretch, 0)
page.Content.Add(image)

image = PdfBitmap(bmp2, 12, 90, 70, 70, PdfBitmap.FillMode.Stretch, 0)
page.Content.Add(image)

doc.Pages.Add(page)


pdfDoc = doc
# ---------- end python_6 ----------
panel_9 = Panel(clean.SynchronousTree2)

# ----
# Wall opening material
panel_10 = Panel("Openings_70")
opaquemod_2 = HBOpaqueModifier(name=panel_10, reflect="0.7")  # -> modifier; plug-in component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

# ----
# Grids
cull_5 = CullPattern(List=graft(layer_name), CullPattern=graft(python_2.is_grid))  # -> simplify(List)
cull_6 = CullPattern(List=geo, CullPattern=python_2.is_grid)
quad_only = Boolean(quadonly)
panel_11 = Panel(cull_5)
clean_3 = CleanTree(RemoveNulls=True, RemoveInvalid=True, RemoveEmpty=True, Tree=cull_5, SynchronousTree1=simplify(cull_6))  # -> Tree, SynchronousTree1
geo_4 = Geometry(graft(clean_3.SynchronousTree1))
name_3 = Text(clean_3.Tree)
rectangle = Rectangle(Plane=PlaneXY(0, 0, 0), XSize=Domain(-1, 1), YSize=Domain(-2, 2), Radius=0)  # -> Rectangle, Length
flip = Flip(Surface=geo_4, Guide=rectangle.Rectangle)  # -> Surface, Result
objatts_2 = ObjectAttributes(ObjectOrAttributes=geo_4)  # -> Name, LayerName, LayerFullPath, Color, MaterialName, LinetypeName, GroupIndices, PlotWeight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
genpts = LBGeneratePointGrid(geometry=flip.Surface, grid_size=grid_size_2, offset_dist=offset, quad_only=quad_only)  # -> points, vectors, face_areas, graft(mesh); plug-in component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
python_7 = GhPythonScript(x=flip.Surface, y="Grid_", z=objatts_2.Name)  # -> out, a; inputs x: list, z: list
# ---------- python_7: Python ----------
__author__ = "mm1013"
__version__ = "2022.08.16"

import rhinoscriptsyntax as rs

o = []
print len(x)
for i in range(0, len(x)):
    if z is not None and z[i] is not None:
        o.append(y + str(i).zfill(2)+ z[i])
    else:
        o.append(y + str(i).zfill(2))
a = o
# ---------- end python_7 ----------
panel_12 = Panel(python_7.a)
sensorgrid = HBSensorGrid(name=python_7.a, positions=genpts.points, directions=genpts.vectors, mesh=genpts.mesh)  # -> grid; plug-in component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
clean_4 = CleanTree(RemoveNulls=True, RemoveInvalid=True, RemoveEmpty=False, Tree=sensorgrid)
panel_13 = Panel(clean_4)

# ----
# Default wall width
panel_14 = Panel("500mm")

# ----
# Default modifers
# (double click to modify)
cluster_2 = Cluster()

# ----
# HB_Rooms
# HB_Windows
cull_7 = CullPattern(List=geo, CullPattern=python_2.is_HB_Window)
cull_8 = CullPattern(List=graft(layer_name), CullPattern=graft(python_2.is_HB_Window))  # -> simplify(List)
cull_9 = CullPattern(List=geo, CullPattern=python_2.is_HB_Room)
rooms = Geometry(flatten(cull_9))
python_8 = GhPythonScript(layer_name=cull_8)  # -> out, transmittance, name; same code as python_5
roomsolid = HBRoomFromSolid(geo=flatten(rooms), conditioned=True)  # -> report, rooms; plug-in component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
clean_5 = CleanTree(
    RemoveNulls=True,
    RemoveInvalid=True,
    RemoveEmpty=True,
    Tree=python_8.transmittance,
    SynchronousTree1=python_8.name,
    SynchronousTree2=simplify(cull_7))  # -> Tree, SynchronousTree1, SynchronousTree2
solveadj = HBSolveAdjacency(rooms=flatten(roomsolid.rooms), run=Toggle(True))  # -> report, adj_rooms; plug-in component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
division = Division(A=clean_5.Tree, B=100)
toggle = BooleanToggle(True)
glassmod_2 = HBGlassModifier(name=clean_5.SynchronousTree1, trans=division)  # -> modifier; plug-in component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
adiabaticbytype = HBAdiabaticByType(
    hb_objs=flatten(solveadj.adj_rooms),
    roofs=Toggle(False),
    exposed_floors=toggle,
    interior_walls=toggle,
    interior_floors=toggle)  # -> hb_objs; plug-in component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
aperture = HBAperture(geo=clean_5.SynchronousTree2, rad_mod=glassmod_2)  # -> report, apertures; plug-in component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
addsubface = HBAddSubface(hb_obj=flatten(adiabaticbytype), sub_faces=flatten(aperture.apertures))  # -> hb_obj; plug-in component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
docunits_3 = ConvertToDocumentUnits(ValueString=panel_14)
bordershades = HBExtrudedBorderShades(hb_objs=flatten(addsubface), depth=docunits_3, rad_mod=opaquemod_2)  # -> report, hb_objs; plug-in component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
applymodset = HBApplyModifierSet(rooms=bordershades.hb_objs, mod_set=cluster_2)  # -> rooms; plug-in component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
gridrooms = HBSensorGridFromRooms(rooms=applymodset, grid_size=grid_size_2, dist_floor=offset, quad_only=quad_only)  # -> grid, points, mesh; plug-in component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

# ----
# Automatic opening by WWR
number_slider = Slider(0.4, range=0..1)
facparam = HBFacadeParameters(north=Slider(0.4, range=0..1), east=number_slider, south=Slider(0.4, range=0..1), west=Slider(0.4, range=0..1))  # -> fac_par; plug-in component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
aperturesbyratio = HBAperturesByRatio(hb_objs=flatten(adiabaticbytype), ratio=facparam)  # -> report, hb_objs; plug-in component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

clean_6 = CleanTree(RemoveNulls=True, RemoveInvalid=True, RemoveEmpty=False, Tree=applymodset)
clean_7 = CleanTree(RemoveNulls=True, RemoveInvalid=True, RemoveEmpty=False, Tree=[clean_4, gridrooms.grid])

# ----
# Assembling model_1 (from rhino)
model = HBModel(rooms=flatten(clean_6), shades=flatten([shade.shades, shade_2.shades]), name=project_name)  # -> report, model; plug-in component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
assigngrids = Object(model=model.model, grids=flatten(clean_7))  # -> model; plug-in component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

# ----
# Parameters
simulation_type_2 = Integer(simulation_type)
expression = Expression(x=ambient_bounces, Expression="Format(\"-ab {0:0}\", x)")
panel_15 = Panel("""0
2
1""")
detail_level_2 = Integer(detail_level)
item = ListItem(List=panel_15, Index=simulation_type_2, Wrap=True)
radpar = HBRadianceParameter(recipe_type=item, detail_level=detail_level_2, additional_par=expression)  # -> rad_par; plug-in component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
panel_16 = Panel(radpar)

falsestart_3 = LBFalseStartToggle(False)
checkscene = HBCheckScene(hb_objs=flatten(assigngrids), run=falsestart_3)  # -> report, hdr; plug-in component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
imageviewer = LBImageViewer(ImagePath_=checkscene.hdr, _scale_=1, DisableClickable=False, SaveImgWithCoords=False, scale=1)  # -> ImagePath, Values, GIF

epw = FilePath(python)

# ----
# Preview materials
model_2 = Data(assigngrids)
faceradianceattr_2 = HBFaceRadianceAttributes({"Modifier": "properties.radiance.modifier.display_name", "Average Reflectance": "properties.radiance.modifier.average_reflectance", "Average Transmittance": "properties.radiance.modifier.average_transmittance", "Modifier Blk": "properties.radiance.modifier_blk.display_name", "Is Opaque": "properties.radiance.is_opaque", "Dynamic Group": "properties.radiance.dynamic_group_identifier", "State Count": "properties.radiance.state_count", "States": "properties.radiance.states"}, selected="Modifier")
vizwiref = HBVisualizeWireframe(hb_objs=flatten(model_2))  # -> geo; disabled; plug-in component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
colorfaceattr_2 = HBColorFaceAttributes(hb_objs=flatten(model_2), attribute=faceradianceattr_2)  # -> mesh, legend, wire_frame, values, colors; disabled; plug-in component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
preview = CustomPreview(Geometry=vizwiref, Material=ColourSwatch(SwatchColor=RGB(140, 140, 140)))

# ----
# EN17037 - Daylight Hours
importepw = LBImportEPW(epw_file=epw)  # -> location, dry_bulb_temperature, dew_point_temperature, relative_humidity, wind_speed, wind_direction, direct_normal_rad, diffuse_horizontal_rad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; plug-in component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
xdata = LBDeconstructData(data=importepw.diffuse_horizontal_rad)  # -> header, values; plug-in component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
lng = ListLength(List=xdata.values)
series = Series(Start=0, Step=1, Count=lng)
sort = SortList(Keys=xdata.values, ValuesA=series)  # -> reverse(Keys), reverse(ValuesA)
subset = SubList(List=sort.ValuesA, Domain="0 to 4379", Wrap=True)  # -> List, Index
int = Integer("0")
dup = DuplicateData(Data=int, Number="8760", Order=True)
int_2 = Integer("1")
constrheader = LBConstructHeader(data_type="Illuminance", unit="lux")  # -> header; plug-in component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
replace = ReplaceItems(List=dup, Item=int_2, Indices=subset.List, Wrap=False)
schedule = Integer(replace)
data = LBConstructData(header=constrheader, values=schedule)  # -> data; plug-in component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
hourlyplot = LBHourlyPlot(data=data)  # -> report, mesh, legend, borders, labels, title; plug-in component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
schedule_2 = Integer(replace)
fixedintervalschedule = HBFixedIntervalSchedule(values=schedule_2, name="EN_DaylightHours")  # -> report, schedule; plug-in component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

# ----
# Fixed Schedule
panel_17 = Panel("1")  # disabled
panel_18 = Panel("31")  # disabled
panel_19 = Panel("12")  # disabled
panel_20 = Panel("8")  # disabled
panel_21 = Panel("18")  # disabled
analysisperiod = LBAnalysisPeriod(start_month=panel_17, start_day=panel_17, start_hour=panel_20, end_month=panel_19, end_day=panel_18, end_hour=panel_21)  # -> period, hoys, dates; disabled; plug-in component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
panel_22 = Panel("8760")  # disabled
panel_23 = Panel("0")  # disabled
int_3 = Integer(panel_23)  # disabled
panel_24 = Panel("lux")  # disabled
panel_25 = Panel("Illuminance")  # disabled
panel_26 = Panel("1")  # disabled
dup_2 = DuplicateData(Data=int_3, Number=panel_22, Order=True)  # disabled
int_4 = Integer(panel_26)  # disabled
constrheader_2 = LBConstructHeader(data_type=panel_25, unit=panel_24)  # -> header; disabled; plug-in component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
replace_2 = ReplaceItems(List=dup_2, Item=int_4, Indices=analysisperiod.hoys, Wrap=False)  # disabled
schedule_3 = Integer(replace_2)  # disabled
expression_2 = Expression(x=panel_20, y=panel_21, Expression="Format(\"Fixed Schedule from {0} to {1}\", x, y)")  # disabled
data_2 = LBConstructData(header=constrheader_2, values=schedule_3)  # -> data; disabled; plug-in component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
hourlyplot_2 = LBHourlyPlot(data=data_2)  # -> report, mesh, legend, borders, labels, title; disabled; plug-in component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
schedule_4 = Integer(replace_2)  # disabled
fixedintervalschedule_2 = HBFixedIntervalSchedule(values=schedule_4, name=expression_2)  # -> report, schedule; disabled; plug-in component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

export = LBFalseStartToggle(False)
model_3 = Data(assigngrids)
python_9 = GhPythonScript()  # -> local_path; same code as python
cull_10 = CullPattern(List=model_3, CullPattern=export)

# ----
# a new model without apertures
panel_27 = Panel("RadianceExport_Advanced")
python_10 = GhPythonScript(x=cull_10)  # -> out, a
# ---------- python_10: Python ----------
__author__ = "mm1013"
__version__ = "2022.08.16"

import rhinoscriptsyntax as rs

v = x.duplicate()
v.remove_all_apertures()
a = v
# ---------- end python_10 ----------
bool = Boolean(export)
folder = Text(python_9)
concat_2 = Concatenate(FragmentA=folder, FragmentB=panel_27)
panel_28 = Panel(concat_2)
modeltorad = HBModelToRadFolder(model=python_10.a, folder=panel_28, write=bool)  # -> report, folder; plug-in component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

line = Line()
north = GhPythonScript(line_input=line)  # -> north_vector; inputs line_input: Line
# ---------- north: Python ----------
__author__ = "mm1013"
__version__ = "2022.01.17"

import rhinoscriptsyntax as rs
import Rhino

if line_input is not None:
    
    north_vector = line_input.Direction
    north_vector.Unitize()
    start_point = line_input.From
else:
    north_vector = Rhino.Geometry.Vector3d(0,1,0)
    start_point = Rhino.Geometry.Point3d(0,0,0)

display_vector = north_vector * 10000
# ---------- end north ----------
end = EndPoints(Curve=line)  # -> Start, End
compass = LBCompass(north=north, center=end.Start)  # -> compass; plug-in component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

default = DefaultMSS(data=flatten(bool), default_value_flattened=flatten(modeltorad.report))

# ----
# export apertures as stand alone rad files
python_11 = GhPythonScript(x=model_3)  # -> out, wins
# ---------- python_11: Python ----------
__author__ = "mm1013"
__version__ = "2022.08.16"

import rhinoscriptsyntax as rs

wins = [v for v in x.shades if not v.properties.radiance.is_opaque]
#shades = [v for v in x.shades if v.properties.radiance.is_opaque]
# ---------- end python_11 ----------
python_12 = GhPythonScript(x=python_11.wins)  # -> name, modifier
# ---------- python_12: Python ----------
__author__ = "mm1013"
__version__ = "2022.08.16"

import rhinoscriptsyntax as rs

name = x.properties.radiance.modifier.identifier
modifier = x.properties.radiance.modifier
# ---------- end python_12 ----------
# Advanced export - requires HoneybeePlus
# This is a tweaked export to seperate the apertures from the rest of the building.
# This will help when doing manual multiphase simulations as per Eleonoras tutorial
vizall = HBVisualizeAll(hb_objs=flatten(python_11.wins))  # -> geo; plug-in component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
cset_2 = CreateSet(List=python_12.name)  # -> graft(Set), Map
assign_paths_2 = AssignPaths(InputData=flatten(python_12.name), PathsToAssign=flatten(cset_2.Map))
assign_paths_3 = AssignPaths(InputData=flatten(vizall), PathsToAssign=flatten(cset_2.Map))
item_2 = ListItem(List=assign_paths_2, Index=0, Wrap=True)
python_13 = GhPythonScript(x=item_2)  # -> out, a
# ---------- python_13: Python ----------
__author__ = "mm1013"
__version__ = "2022.08.16"

import rhinoscriptsyntax as rs

a = float(x.split("_")[-1])
# ---------- end python_13 ----------
division_2 = Division(A=python_13.a, B=100)
radglassmat = HoneybeePlus_RadianceGlassMaterial(name=graft(cset_2.Set), t_vis=graft(division_2))  # -> graft(material); plug-in component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
concat_3 = Concatenate(FragmentA=cset_2.Set, FragmentB=".rad")
hbwinsrf = HoneybeePlus_HoneybeeWindowSurface(geo=assign_paths_3, names=cset_2.Set, rad_mat=radglassmat)  # -> report, HB_win_srf; plug-in component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
concat_4 = Concatenate(FragmentA=concat_2, FragmentB="\model\aperture\")
hbtorad = HoneybeePlus_WriteHBObjectsToRadiance(HB_objects=hbwinsrf.HB_win_srf, folder=concat_4, file_name=concat_3, write=default)  # -> rad_file; plug-in component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

# ----
# Pollination cloud
dam_2 = DataDam(DataA=assigngrids, BufferDelay=10000000, BufferMode=0)
param = Data(radpar)
setup_runs = SetupRuns(
    _model=dam_2,
    Cpu_count_=50,
    Grid_filter_="*",
    Min_sen_count_=200,
    Radiance_par_=param,
    Owner="ladybug-tools",
    RecipeJsonString="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",
    project="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")
pollinate = Pollinate(
    _runs=flatten(setup_runs),
    _name_="NLITED_Pollinate_Test",
    CPUNumber=10,
    IfEnabledRemoteRun=False,
    RunLocal=False,
    LBTFolder="C:\Users\mm1013\ladybug_tools",
    liveUpdateStatus=True,
    workingDir="C:\Users\mm1013\simulation")
check_job_status = CheckJobStatus(_job=pollinate, Index_=0, getBothInputOutputAssets=False, liveUpdateStatus=True)
check_run_results = CheckRunResults(
    _run=check_job_status,
    recipeSource="https://api.pollination.cloud/registries/ladybug-tools/recipe/daylight-factor/0.7.0")
load_assets = LoadAssets(Asset_1=check_run_results, liveUpdateStatus=True, postprocessWithHandler=True, useCachedAssets=True)  # -> Logs, Value_1, Value_2
panel_29 = Panel(load_assets.Value_1)
daylight_factor = Number(load_assets.Value_1)

# ----
# download model and results from collaborators etc
check_job_status_2 = CheckJobStatus(
    _job="sonderwoods/demo/4e6a9f82-960b-40c0-85f9-e1ec107674bb",
    Index_=0,
    getBothInputOutputAssets=False,
    liveUpdateStatus=True)
check_run_inputs = CheckRunInputs(
    _run=check_job_status_2,
    recipeSource="https://api.pollination.cloud/registries/ladybug-tools/recipe/daylight-factor/0.7.0")  # -> CpuCount, GridFilter, MinSensorCount, Model, RadianceParameters
check_run_results_2 = CheckRunResults(
    _run=check_job_status_2,
    recipeSource="https://api.pollination.cloud/registries/ladybug-tools/recipe/daylight-factor/0.7.0")
load_assets_2 = LoadAssets(
    Asset_1=check_run_inputs.Model,
    Asset_2=check_run_results_2,
    liveUpdateStatus=True,
    postprocessWithHandler=True,
    useCachedAssets=True)  # -> Logs, Value_1, Value_2, Value_3
toggle_2 = BooleanToggle(True)  # disabled
loadobjects = HBLoadObjects(hb_file=load_assets_2.Value_1, load=toggle_2)  # -> report, hb_objs; disabled; plug-in component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
vizquick = HBVisualizeQuick(hb_objs=flatten(loadobjects.hb_objs))  # -> geo; disabled; plug-in component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
panel_30 = Panel(loadobjects.hb_objs)  # disabled
getgridsviews = HBGetGridsAndViews(model=loadobjects.hb_objs)  # -> views, grids, points, meshes; disabled; plug-in component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

simulation_type_3 = Integer(simulation_type)
equals = Equality(FirstNumber=simulation_type_3, SecondNumber="2")  # -> Equality, Inequality
and = GateAnd(A=equals.Equality, B=run)

simulation_type_4 = Integer(simulation_type)
equals_2 = Equality(FirstNumber=simulation_type_4, SecondNumber="0")  # -> Equality, Inequality
and_2 = GateAnd(A=equals_2.Equality, B=run)

panel_31 = Panel(concat_4)

# ----
# Daylight factor
param_2 = Data(radpar)
daylightfactor = HBDaylightFactor(model=assigngrids, radiance_par=param_2, run=and_2)  # -> report, results; plug-in component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

simulation_type_5 = Integer(simulation_type)
equals_3 = Equality(FirstNumber=simulation_type_5, SecondNumber="1")  # -> Equality, Inequality
and_3 = GateAnd(A=equals_3.Equality, B=run)

# ----
# Annual Daylight
c_script = CSharpScript(vect=north, run=and_3)  # -> north; inputs vect: Vector3d, run: Boolean
# ---------- c_script: C# usings ----------
using System.Windows.Forms;
# ---------- c_script: C# ----------
    if(run)
    {
      v = vect;
      if(vect.X == 0 && vect.Y > 0.1)
      {
        north = v;
      }
      else
      {
        DialogResult dialogResult = MessageBox.Show("You have a custom north vector! Is that on purpose?\n\nYes: keep it\nNo: use north = y-direction (up in topview)", "North position", MessageBoxButtons.YesNo);
        if(dialogResult == DialogResult.Yes)
        {
          north = v;
        }
        else if (dialogResult == DialogResult.No)
        {

          v = new Vector3d(0, 1, 0);
          north = v;
        }
      }
    }
    else
    {
      north = v;
    }
# ---------- c_script: C# additional code ----------
  Vector3d v = new Vector3d(0, 0, 0);
# ---------- end c_script ----------
param_3 = Data(radpar)
annualdaylight = HBAnnualDaylight(
    model=assigngrids,
    wea=wea,
    north=c_script,
    thresholds="-t 300",
    schedule=fixedintervalschedule.schedule,
    radiance_par=param_3,
    run=and_3)  # -> report, results, DA, cDA, UDI, UDI_low, UDI_up; plug-in component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

# ----
# Cycle through the annual results
shift = ShiftList(List=annualdaylight.results, Shift=-1, Wrap=False)
panel_32 = Panel(annualdaylight.results)
file = ReadFile(File=shift, PerLineParse=True)  # -> flatten(Content)
legendpar = LBLegendParameters(min="0", max="2000")  # -> leg_par; plug-in component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
docunits_4 = ConvertToDocumentUnits(ValueString="10m")
c_script_2 = CSharpScript(x=file, y=Slider(1406, range=0..4000))  # -> out, A, B; inputs x: list of String, y: Int32
# ---------- c_script_2: C# ----------
    List<double> outDoubles = new List<double>();
    List<string> outStrings = new List<string>();
   
    foreach(string pt in x)
    {
      outStrings.Add(pt.Split(' ').Where(s => !String.IsNullOrEmpty(s)).Skip(y).FirstOrDefault());




      outDoubles.Add(double.Parse(outStrings[outStrings.Count - 1]));


    }
    B = outStrings;
    A = outDoubles;
# ---------- end c_script_2 ----------
simulation_type_6 = Integer(simulation_type)
Z = UnitZ(Factor=docunits_4)
expression_3 = Expression(x=c_script_2.A, Expression="Format(\"{0:0}\", x)")
filter = StreamFilter(Gate=simulation_type_6, Stream0=daylightfactor.results, Stream1=annualdaylight.DA)
panel_33 = Panel(c_script_2.B)
panel_34 = Panel(c_script_2.A)
docunits_5 = ConvertToDocumentUnits(ValueString="100mm")

colrange = LBColorRange(index=Slider(7, range=0..25))  # -> colors; plug-in component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
legendpar_2 = LBLegendParameters(min="0", max="100", seg_count="11", colors=colrange, num_decimals="0")  # -> leg_par; plug-in component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

pt = Point(Point(-3269.453823, -29377.65348, 2918.057305))
simulation_type_7 = Integer(simulation_type)

colrange_2 = LBColorRange(index=Slider(3, range=0..25))  # -> colors; plug-in component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
legendpar_3 = LBLegendParameters(
    min="0",
    max="15",
    seg_count="11",
    colors=colrange_2,
    num_decimals="0",
    base_plane=pt,
    seg_height="700",
    seg_width="1200",
    text_height="500")  # -> leg_par; plug-in component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

col = Colour([RGB(255, 248, 122), RGB(255, 248, 122), RGB(255, 248, 122), RGB(255, 248, 122), RGB(255, 248, 122), RGB(255, 248, 122), RGB(255, 248, 122), RGB(255, 248, 122), RGB(255, 248, 122), RGB(189, 189, 189)])
simulation_type_8 = Integer(simulation_type)
filter_2 = StreamFilter(Gate=simulation_type_8, Stream0=legendpar_3, Stream1=legendpar_2)
simulation_type_9 = Integer(simulation_type)
simulation_type_10 = Integer(simulation_type)
docunits_6 = ConvertToDocumentUnits(ValueString="100mm")
radviewer = RadViewer(IsTwoSided=False, Polychromatic=True, ShowEdges=True, Transparent=True)  # -> Meshes, Names, ModifierNames, Modifiers

assigngridsviews = HBAssignGridsAndViews(model=assigngrids, views=flatten(viewport))  # -> model; plug-in component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
ciesky = HBCIEStandardSky(
    north=north,
    location=importloc,
    month=Slider(3, range=1..12),
    day=Slider(21, range=1..22),
    hour=Slider(12, range=0..23),
    type=0)  # -> sky; plug-in component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
param_4 = Data(radpar)

# ----
# Point in Time
pitgrid = HBPointInTimeGridBased()  # -> report, results; plug-in component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
pitview = HBPointInTimeViewBased(model=assigngridsviews, sky=ciesky, metric=metric, radiance_par=param_4, run=and)  # -> report, results; plug-in component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

panel_35 = Panel(pitview.results)

glare = HBGlarePostprocess(hdr=pitview.results)  # -> DGP, category, glare_indices, check_hdr; plug-in component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
falsecolor = HBFalseColor(hdr=pitview.results, contour_lines=Toggle(True))  # -> hdr; plug-in component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
adjusthdr = HBAdjustHDR(hdr=falsecolor, adj_expos=Toggle(True))  # -> hdr; plug-in component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
hdr_gif = HBHDRToGIF(hdr=adjusthdr)  # -> gif; plug-in component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
imageviewer_2 = LBImageViewer(ImagePath_=falsecolor, _scale_=1, DisableClickable=False, SaveImgWithCoords=False, scale=1)  # -> ImagePath, Values, GIF
panel_36 = Panel(hdr_gif)

panel_37 = Panel(glare.category)
panel_38 = Panel(glare.DGP)
panel_39 = Panel(imageviewer_2.Values)

# ----
# Visualize
# Results
panel_40 = Panel("Daylight Factor (%)")
getgridsviews_2 = HBGetGridsAndViews(model=assigngrids)  # -> views, grids, points, meshes; plug-in component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
# GRID BASED RESULTS
values = Data(flatten(filter))
mesh_6 = Mesh(flatten(getgridsviews_2.meshes))
c_script_3 = CSharpScript(inResults=values)  # -> outResults; inputs inResults: list of Double
# ---------- c_script_3: C# ----------
    if (inResults != null && inResults.Count > 1)
    {
      results = inResults;
    }

    outResults = results;
# ---------- c_script_3: C# additional code ----------
  List<double> results = new List<double>();
# ---------- end c_script_3 ----------
mjoin = MeshJoin(Meshes=mesh_6)

filter_3 = StreamFilter(Gate=simulation_type_7, Stream0=panel_40, Stream1="Daylight Autonomy (%)")
mjoin_2 = MeshJoin(Meshes=flatten(mesh_6))
move = Move(Geometry=mjoin_2, Motion=Z)  # -> Geometry, Transform
facen = FaceNormals(Mesh=move.Geometry)  # -> Centers, Normals
heatmap = LBSpatialHeatmap(values=c_script_2.A, mesh=move.Geometry, legend_par=legendpar)  # -> mesh, legend, title, colors, legend_par; plug-in component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
tag = TextTag3D(
    Location=facen.Centers,
    Text=expression_3,
    Size=docunits_5,
    Colour=ColourSwatch(SwatchColor=RGB(0, 0, 0)),
    Justification=5)

heatmap_2 = LBSpatialHeatmap(values=flatten(c_script_3), mesh=flatten(mjoin_2), legend_par=filter_2, legend_title=filter_3)  # -> mesh, legend, title, colors, legend_par; plug-in component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

expression_4 = Expression(x=c_script_3, Expression="Format(\"{0:0}\", x)")
expression_5 = Expression(x=c_script_3, Expression="Format(\"{0:0.0}\", x)")
facen_2 = FaceNormals(Mesh=mjoin)  # -> Centers, Normals
filter_4 = StreamFilter(Gate=simulation_type_9, Stream0=expression_5, Stream1=expression_4)
tag_2 = TextTag3D(Location=facen_2.Centers, Text=filter_4, Size=docunits_6, Colour=ColourSwatch(SwatchColor=RGB(0, 0, 0)), Justification=5)

# ----
# Floor area above xxx DA/DF
simulation_type_11 = Integer(simulation_type)
mesh_explode = MeshExplode(m=mjoin)  # -> out, simplify(A)
# ---------- mesh_explode: VB usings ----------
Imports System.IO
Imports System.Linq
Imports System.Data
Imports System.Drawing
Imports System.Reflection
Imports System.Windows.Forms
Imports System.Xml
Imports System.Xml.Linq
Imports Microsoft.VisualBasic
Imports System.Runtime.InteropServices

Imports Rhino.DocObjects
Imports Rhino.Collections
Imports GH_IO
Imports GH_IO.Serialization
# ---------- mesh_explode: VB ----------
    Component.Params.Input(0).Name = "Mesh"
    Component.Params.Input(0).Description = "Open or closed mesh"

    Component.Params.Output(1).Name = "Mesh"
    Component.Params.Output(1).Description = "If successful, a valid mesh"

    If m IsNot Nothing Then
      Dim pts As Rhino.Geometry.Collections.MeshVertexList
      Dim faces As Rhino.Geometry.Collections.MeshFaceList
      Dim clrs As Rhino.Geometry.Collections.MeshVertexColorList
      Dim i As Integer
      Dim mshs As New list(Of mesh)

      faces = m.Faces
      pts = m.Vertices
      If m.VertexColors.count() = 0 Then m.VertexColors.CreateMonotoneMesh(color.FromArgb(100, 100, 100))
      clrs = m.VertexColors

      For i = 0 To faces.count() - 1 Step 1
        Dim fc As New meshFace
        Dim face As New MeshFace
        Dim ptList As New list(Of point3d)
        Dim clrList As New list(Of color)
        Dim msh As New mesh

        face = faces(i)

        ptList.add(New point3d(pts(face.A)))
        ptList.add(New point3d(pts(face.B)))
        ptList.add(New point3d(pts(face.C)))
        If face.IsQuad Then ptList.add(New point3d(pts(face.D)))

        clrList.add(clrs(face.A))
        clrList.add(clrs(face.B))
        clrList.add(clrs(face.C))
        If face.IsQuad Then clrList.add(clrs(face.D))

        If face.IsQuad Then fc = New meshFace(0, 1, 2, 3) Else fc = New meshface(0, 1, 2)

        msh.Vertices.AddVertices(ptList.toarray())
        msh.Faces.AddFace(fc)
        msh.VertexColors.SetColors(clrList.toarray())
        mshs.add(msh)
      Next

      A = mshs
    End If
# ---------- end mesh_explode ----------
threshold = Panel("""1.95
50""")
facen_3 = FaceNormals(Mesh=mesh_6)  # -> Centers, Normals
name_4 = Panel("""DF
DA""")
unflatten = UnflattenTree(Tree=c_script_3, Guide=facen_3.Centers)
unflatten_2 = UnflattenTree(Tree=mesh_explode.A, Guide=facen_3.Centers)
item_3 = ListItem(List=threshold, Index=simulation_type_11, Wrap=True)
item_4 = ListItem(List=name_4, Index=simulation_type_11, Wrap=True)
larger = LargerThan(FirstNumber=unflatten, SecondNumber=item_3)  # -> LargerThan, OrEqualTo
cull_11 = CullPattern(List=unflatten_2, CullPattern=larger.LargerThan)
area = Area(Geometry=unflatten_2)  # -> Area, Centroid
area_2 = Area(Geometry=cull_11)  # -> Area, Centroid
ma = MassAddition(Input=area.Area)  # -> Result, PartialResults
ma_2 = MassAddition(Input=area_2.Area)  # -> Result, PartialResults
division_3 = Division(A=ma_2.Result, B=ma.Result)
multiplication = Multiplication(A=division_3, B=100)
mjoin_3 = MeshJoin(Meshes=cull_11)
expression_6 = Expression(x=multiplication, y=item_3, z=item_4, Expression="Format(\"Floor area above {2}{1}: {0:0.0}%\", x, y, z)")
medges = MeshEdges(Mesh=mjoin_3)  # -> NakedEdges, InteriorEdges, NonManifoldEdges
crv = Curve(medges.NakedEdges)
docunits_7 = ConvertToDocumentUnits(ValueString="300mm")
preview_2 = CustomPreview(Geometry=crv, Material=ColourSwatch(SwatchColor=RGB(255, 255, 255)))
panel_41 = Panel(expression_6)

# ----
# Average DF pr room
mesh_explode_2 = MeshExplode(m=mjoin)  # -> out, simplify(A); same code as mesh_explode
facen_4 = FaceNormals(Mesh=mesh_6)  # -> Centers, Normals
unflatten_3 = UnflattenTree(Tree=mesh_explode_2.A, Guide=facen_4.Centers)
unflatten_4 = UnflattenTree(Tree=c_script_3, Guide=facen_4.Centers)
area_3 = Area(Geometry=unflatten_3)  # -> Area, Centroid
avr = Average(Input=area_3.Centroid)
wav = WeightedAverage(Input=unflatten_4, Weights=area_3.Area)
expression_7 = Expression(x=wav, Expression="Format(\"Average DF {0:0.0}%\", x)")
docunits_8 = ConvertToDocumentUnits(ValueString="400mm")
panel_42 = Panel(expression_7)

filter_5 = StreamFilter(Gate=simulation_type_10, Stream0=avr)

tag_3 = TextTag3D(Location=filter_5, Text=expression_7, Size=docunits_8, Colour=ColourSwatch(SwatchColor=RGB(0, 0, 0)), Justification=5)

tag_4 = TextTag3D(Location=avr, Text=expression_6, Size=docunits_7, Colour=ColourSwatch(SwatchColor=RGB(0, 0, 0)), Justification=5)

# ==== cluster Cluster
# Default modifiers
panel = Panel("HB_Exterior_Wall_50")
opaquemod = HBOpaqueModifier(name="HB_Inner_Wall_50", reflect="0.5")  # -> modifier; plug-in component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
opaquemod_2 = HBOpaqueModifier(name=panel, reflect="0.5")  # -> modifier; plug-in component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
opaquemod_3 = HBOpaqueModifier(name="HB_Ceilings_70", reflect="0.7")  # -> modifier; plug-in component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
opaquemod_4 = HBOpaqueModifier(name="HB_Floors_20", reflect="0.2")  # -> modifier; plug-in component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
interiorsubset = HBInteriorModifierSubset(interior_wall=opaquemod, ceiling=opaquemod_3, interior_floor=opaquemod_4)  # -> interior_set; plug-in component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
shadesubset = HBShadeModifierSubset(exterior_shade=opaquemod_2)  # -> shade_set; plug-in component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
exteriorsubset = HBExteriorModifierSubset(exterior_wall=opaquemod_2, exterior_roof=opaquemod_3, exposed_floor=opaquemod_4)  # -> exterior_set; plug-in component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
modifierset = HBModifierSet(name="Standard_Compliance", exterior_subset=exteriorsubset, interior_subset=interiorsubset, shade_subset=shadesubset)  # -> mod_set; plug-in component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
mod_set = ClusterOutput(modifierset)

# ==== cluster DefaultMSS
default_value_flattened = ClusterInput()
data = ClusterInput()
data_2 = Data(data)
merge = Merge(Data1=flatten(data_2), Data2="0")  # -> flatten(Result)
default_value_flattened_2 = Data(flatten(default_value_flattened))
lng = ListLength(List=merge)
equals = Equality(FirstNumber=lng, SecondNumber="1")  # -> Equality, Inequality
cull = CullPattern(List=data_2, CullPattern=invert(equals.Equality))
panel = Panel(equals.Equality)
cull_2 = CullPattern(List=default_value_flattened_2, CullPattern=equals.Equality)
data_3 = Data([cull, cull_2])
data_4 = ClusterOutput(data_3)

# ==== cluster LargestBREP
window_breps = ClusterInput()
window_breps_2 = Brep(window_breps)
debrep = DeconstructBrep(Brep=window_breps_2)  # -> Faces, Edges, Vertices
area = Area(Geometry=debrep.Faces)  # -> Area, Centroid
sort = SortList(Keys=area.Area, ValuesA=debrep.Faces)  # -> Keys, ValuesA
item = ListItem(List=sort.ValuesA, Index=-1, Wrap=True)
group = Group(Objects=flatten(item))
grouped = ClusterOutput(group)

# ==== cluster Cluster_2
M = ClusterInput()
disjoint = DisjointMesh(Mesh=M)  # -> flatten(Meshes)
lng = ListLength(List=disjoint)  # -> simplify(Length)
series = Series(Start=0, Step=1, Count=lng)
facen = FaceNormals(Mesh=disjoint)  # -> Centers, Normals
explode = MeshExplode(Mesh=disjoint, Interpolate=False)
lng_2 = ListLength(List=explode)  # -> simplify(Length)
dup = DuplicateData(Data=graft(series), Number=lng_2, Order=True)  # -> simplify(graft(Data))
cset = CreateSet(List=facen.Normals)  # -> Set, simplify(graft(Map))
merge = Merge(Data1=dup, Data2=cset.Map)
path = ConstructPath(Indices=merge)
assign_paths = AssignPaths(InputData=flatten(explode), PathsToAssign=flatten(path))
mjoin = MeshJoin(Meshes=assign_paths)
abx = ABX(data=mjoin, pathCount=1)  # -> data; inputs data: tree, pathCount: Int32
# ---------- abx: C# usings ----------
using System.Linq;
# ---------- abx: C# ----------
    DataTree<object> newTree = new DataTree<object>();
    _data.SimplifyPaths();
    var y = _data.Paths;
    if (pathCount < 1)
    {
      pathCount = 1;
    }


    for (int i = 0; i < _data.BranchCount; i++)
    {
      GH_Path oldPath = _data.Paths[i];
      GH_Path p = new GH_Path(oldPath.Indices.Take(pathCount).ToArray());


      newTree.AddRange(_data.Branches[i], p);
    }
    data = newTree;
# ---------- end abx ----------
area = Area(Geometry=abx)  # -> Area, Centroid
sort = SortList(Keys=area.Area, ValuesA=abx)  # -> Keys, ValuesA
item = ListItem(List=sort.ValuesA, Index=-1, Wrap=True)
group = Group(Objects=flatten(item))
grouped = ClusterOutput(group)

# ==== cluster DECKS10
mesh = ClusterInput()
mesh_2 = Mesh(mesh)
mjoin = MeshJoin(Meshes=flatten(mesh_2))
facen = FaceNormals(Mesh=mjoin)  # -> Centers, Normals
horiz_vect_2_2 = HorizontalVector(vec_2=facen.Normals)  # -> vec_6, tilt_angle_deg_2, pointing_up_2, vertical_2, pointing_down_2, data_2, pointing_straight_up_2, vertical_ish_2, pointing_straight_down_2
cullf = CullFaces(Mesh=mjoin, Pattern=horiz_vect_2_2.vertical_ish_2)
cullf_2 = CullFaces(Mesh=mjoin, Pattern=horiz_vect_2_2.pointing_straight_down_2)
cullf_3 = CullFaces(Mesh=mjoin, Pattern=horiz_vect_2_2.pointing_straight_up_2)
mesh_ceiling = Mesh(cullf_2)
mesh_wall = Mesh(cullf)
mesh_floor = Mesh(cullf_3)
preview = CustomPreview(Geometry=cullf, Shader=ColourSwatch(SwatchColor=RGB(86, 125, 72)))
preview_2 = CustomPreview(Geometry=cullf_2, Shader=ColourSwatch(SwatchColor=RGB(222, 142, 22)))
preview_3 = CustomPreview(Geometry=cullf_3, Shader=ColourSwatch(SwatchColor=RGB(199, 196, 28)))
mesh_wall_2 = ClusterOutput(mesh_wall)
mesh_ceiling_2 = ClusterOutput(mesh_ceiling)
mesh_floor_2 = ClusterOutput(mesh_floor)

# ==== cluster HorizontalVector
vec = VectorXYZ(XComponent="0.5", YComponent="0.5", ZComponent="-0.5")  # -> Vector, Length
vec_2 = ClusterInput()
vec_3 = Vector(simplify(vec_2))
devec = DeconstructVector(Vector=vec_3)  # -> XComponent, YComponent, ZComponent
panel = Panel("""-1
1""")
vec_4 = VectorXYZ(XComponent=devec.XComponent, YComponent=devec.YComponent, ZComponent=0)  # -> Vector, Length
larger = LargerThan(FirstNumber=devec.ZComponent, SecondNumber="0")  # -> LargerThan, OrEqualTo
vec_5 = Vector(vec_4.Vector)
item = ListItem(List=panel, Index=larger.LargerThan, Wrap=True)
angle = Angle(VectorA=vec_3, VectorB=vec_5)  # -> expr("abs(deg(x))", graft(Angle)), Reflex
nullrep = ReplaceNulls(Items=angle.Angle, Replacements="90")  # -> Items, Count
trim = TrimTree(Tree=nullrep.Items, Depth=1)
multiplication = Multiplication(A=trim, B=item)
vec_6 = ClusterOutput(vec_5)
tilt_angle_deg = Number(simplify(multiplication))
int = Integer(tilt_angle_deg)
int_2 = Integer(tilt_angle_deg)
panel_2 = Panel(tilt_angle_deg)
smaller = SmallerThan(FirstNumber=int_2, SecondNumber="0")  # -> SmallerThan, OrEqualTo
equals = Equality(FirstNumber=int_2, SecondNumber="0")  # -> Equality, Inequality
larger_2 = LargerThan(FirstNumber=int_2, SecondNumber="0")  # -> LargerThan, OrEqualTo
equals_2 = Equality(FirstNumber=int, SecondNumber="90")  # -> Equality, Inequality
equals_3 = Equality(FirstNumber=int, SecondNumber="-90")  # -> Equality, Inequality
tilt_angle_deg_2 = ClusterOutput(tilt_angle_deg)
bool = Boolean(invert(equals.Equality))
bool_2 = Boolean(invert(larger_2.LargerThan))
bool_3 = Boolean(invert(smaller.SmallerThan))
nor = GateNor(A=equals_2.Equality, B=equals_3.Equality)
bool_4 = Boolean(invert(equals_2.Equality))
bool_5 = Boolean(invert(equals_3.Equality))
bool_6 = Boolean(invert(nor))
pointing_up = Data(bool_2)
vertical = Data(bool)
data = Data()
pointing_down = Data(bool_3)
vertical_ish = Data(bool_6)
pointing_straight_up = Data(bool_4)
pointing_straight_down = Data(bool_5)
vertical_2 = ClusterOutput(vertical)
pointing_up_2 = ClusterOutput(pointing_up)
data_2 = ClusterOutput(data)
pointing_down_2 = ClusterOutput(pointing_down)
pointing_straight_up_2 = ClusterOutput(pointing_straight_up)
pointing_straight_down_2 = ClusterOutput(pointing_straight_down)
vertical_ish_2 = ClusterOutput(vertical_ish)
panel_3 = Panel(vec_3)
