# Grasshopper definition trees.gh (Grasshopper 1.0.7)
# Copyright: 2021
# plug-ins: MeshEdit Components

panel = Panel("0,0,0")  # disabled
panel_2 = Panel("0.6,0.6,0.6")  # disabled
brep = Brep([<brep referenced from the Rhino model> x47])  # disabled
panel_3 = Panel("130")  # disabled
popgeo = PopulateGeometry(Geometry=brep, Count=panel_3, Seed=1)  # disabled
box = Box2Pt(PointA=panel, PointB=panel_2, Plane=PlaneXY(0, 0, 0))  # disabled
brep_2 = Brep(box)  # disabled
pop3d = Populate3D(Region=brep, Count=panel_3, Seed=1)  # disabled
meshit = MeshIt(mesh_brep=brep_2)  # disabled
msphere = MeshSphere(Base=PlaneXY(0, 0, 0), Radius=10, UCount="20", VCount="20")
move = Move(Geometry=meshit, Motion=flatten([popgeo, pop3d]))  # -> Geometry, Transform; disabled
meshit_2 = MeshIt(mesh_brep=flatten(move.Geometry))  # disabled
tri = Triangulate(Mesh=msphere)  # -> Mesh, Count
explode = MeshExplode(Mesh=tri.Mesh, Interpolate=False)
facen = FaceNormals(Mesh=tri.Mesh)  # -> Centers, Normals
lng = ListLength(List=facen.Normals)
random = Random(Range="0.2 to 1.4", Number=lng, Seed="42")
random_2 = Random(Range="0.2 to 1.4", Number=lng, Seed=2)
scale = Scale(Geometry=explode, Center=facen.Centers, Factor=random_2)  # -> Geometry, Transform
xy = XYPlane(Origin=facen.Centers)
rotate = Rotate(Geometry=scale.Geometry, Angle=expr("x / 3", random), Plane=xy)  # -> Geometry, Transform
mjoin = MeshJoin(Meshes=rotate.Geometry)

# ==== cluster MeshIt: Meshes everything in the input. Graft the input if you want to make several meshes, otherwise returns a joined mesh.
mesh_brep = ClusterInput()
mesh_brep_2 = Geometry(simplify(mesh_brep))
tmatch = MatchText(Text=mesh_brep_2, RegEx="(mesh)", Case=False)
tmatch_2 = MatchText(Text=mesh_brep_2, RegEx="(brep)|(polysurface)|(surface)|(extrusion)", Case=False)
group = Group(Objects=mesh_brep_2)
cull = CullPattern(List=mesh_brep_2, CullPattern=tmatch_2)
cull_2 = CullPattern(List=mesh_brep_2, CullPattern=tmatch)
mesh = MeshBrep(
    Brep=cull,
    Settings={GridMaxCount=0, GridMinCount=16, JaggedSeams=False, MaxEdgeLength=0, MinEdgeLength=0.0001, MinTolerance=0, Refine=True, RefineAngle=0, RelativeTolerance=0.65, SimplePlanes=True, Tolerance=0})

# ----
# Fix invalid mesh
panel = Panel("Invalid Mesh")
mesh_2 = Mesh(mesh)
tmatch_3 = MatchText(Text=mesh_2, RegEx=panel, Case=False)
unweave = Unweave(List=mesh_2, UnweavePattern=tmatch_3)  # -> Data0, Data1
explode = MeshExplode(Mesh=unweave.Data1, Interpolate=False)  # -> simplify(Faces)
abc_a = ABC(data=explode)
num = Number("0")
area = MeshArea(Mesh=abc_a)  # -> Area, Centroid
equals = Equality(FirstNumber=area.Area, SecondNumber=num)  # -> Equality, Inequality
cull_3 = CullPattern(List=abc_a, CullPattern=equals.Inequality)
mjoin = MeshJoin(Meshes=[cull_3, unweave.Data0])

# ----
# Fix invalid mesh
panel_2 = Panel("Invalid Mesh")
mesh_3 = Mesh(cull_2)
tmatch_4 = MatchText(Text=mesh_3, RegEx=panel_2, Case=False)
unweave_2 = Unweave(List=mesh_3, UnweavePattern=tmatch_4)  # -> Data0, Data1
explode_2 = MeshExplode(Mesh=unweave_2.Data1, Interpolate=False)  # -> simplify(Faces)
abc_a_2 = ABC(data=explode_2)
num_2 = Number("0")
area_2 = MeshArea(Mesh=abc_a_2)  # -> Area, Centroid
equals_2 = Equality(FirstNumber=area_2.Area, SecondNumber=num_2)  # -> Equality, Inequality
cull_4 = CullPattern(List=abc_a_2, CullPattern=equals_2.Inequality)
mjoin_2 = MeshJoin(Meshes=[cull_4, unweave_2.Data0])

abc_a_3 = ABC(data=mjoin)
abc_a_4 = ABC(data=mjoin_2)
clean = CleanTree(RemoveNulls=True, RemoveInvalid=True, RemoveEmpty=False, Tree=[abc_a_3, abc_a_4])
mjoin_3 = MeshJoin(Meshes=clean)
unflatten = UnflattenTree(Tree=mjoin_3, Guide=group)
panel_3 = Panel(mjoin_3)
mesh_joined = Mesh(unflatten)
mesh_joined_2 = ClusterOutput(mesh_joined)

# ==== cluster ABC
data = ClusterInput()
data_2 = Data(data)
path_mapper = PathMapper(
    data_2,
    source=["{A;B;C;D;E;F;G}", "{A;B;C;D;E;F}", "{A;B;C;D;E}", "{A;B;C;D}", "{A;B;C}", "{A;B}", "{A}"],
    target=["{A}", "{A}", "{A}", "{A}", "{A}", "{A}", "{A}"])
data_3 = Data(path_mapper)
data_4 = ClusterOutput(data_3)
